# Dynamo graph Bounding Boxes.dyn (Dynamo 3.3.0.6316)

select_model_element = DSModelElementSelection()  # 1 picked in the model
find_clashes_and_create_views = Python(IN[0]=select_model_element)  # CPython3; unwired: IN[1]
# ---------- find_clashes_and_create_views.python (94 lines) ----------
import clr

import sys
sys.path.append('C:\Program Files (x86)\IronPython 2.7\Lib')

import System
from System.Collections.Generic import *

clr.AddReference('ProtoGeometry')
from Autodesk.DesignScript.Geometry import *

clr.AddReference("RevitNodes")
import Revit
clr.ImportExtensions(Revit.Elements)
clr.ImportExtensions(Revit.GeometryConversion)
clr.AddReference("RevitServices")
import RevitServices
from RevitServices.Persistence import DocumentManager 
from RevitServices.Transactions import TransactionManager 

clr.AddReference("RevitAPI")
clr.AddReference("RevitAPIUI")

import Autodesk 
from Autodesk.Revit.DB import *
from Autodesk.Revit.DB.Mechanical import *
from Autodesk.Revit.DB.Electrical import *
from Autodesk.Revit.UI import *

doc = DocumentManager.Instance.CurrentDBDocument
uiapp = DocumentManager.Instance.CurrentUIApplication 
app = uiapp.Application 
uidoc = uiapp.ActiveUIDocument

def tolist(obj1):
	if isinstance(obj1,(list, tuple, set)): return obj1
	else: return [obj1]

#Preparing input from dynamo to revit
ele = UnwrapElement(IN[0])

#Do some action in a Transaction

TransactionManager.Instance.EnsureInTransaction(doc)

catList = List[BuiltInCategory]()
catList.Add(BuiltInCategory.OST_DuctCurves)
catList.Add(BuiltInCategory.OST_CableTray)
catList.Add(BuiltInCategory.OST_PipeCurves)


catFilter = ElementMulticategoryFilter(catList)


bb = ele.get_BoundingBox(None)

ot = Outline(bb.Min, bb.Max)

bbFilter = BoundingBoxIntersectsFilter(ot)

clashes = FilteredElementCollector(doc).WherePasses(catFilter).WherePasses(bbFilter).ToElements()
"""
wallComments = ele.LookupParameter("Comments").AsString()

for clash in clashes:
    clash.LookupParameter("Comments").Set(wallComments)

"""
"""
public static View3D CreateIsometric(
    Document document,
    ElementId viewFamilyTypeId
)
  
vfts = FilteredElementCollector(doc).OfClass(ViewFamilyType).ToElements()

for vft in vfts:
    if vft.ViewFamily == ViewFamily.ThreeDimensional:
        view3DType = vft

new3dView = View3D.CreateIsometric(doc, view3DType.Id)
new3dView.Name = "Clash View-"+str(ele.Id.IntegerValue)

idList = List[ElementId]()
for clash in clashes:
    idList.Add(clash.Id)

idList.Add(ele.Id)

new3dView.IsolateElementsTemporary(idList)
"""
TransactionManager.Instance.TransactionTaskDone()

OUT = view3DType
# ----------------------------------------
select_model_elements = DSModelElementsSelection()  # 3 picked in the model
select_model_element_2 = DSModelElementSelection()  # 1 picked in the model
python_script = Python(IN[0]=select_model_element_2)  # CPython3
# ---------- python_script.python (67 lines) ----------
import clr

import sys
sys.path.append('C:\Program Files (x86)\IronPython 2.7\Lib')

import System
from System.Collections.Generic import *

clr.AddReference('ProtoGeometry')
from Autodesk.DesignScript.Geometry import *

clr.AddReference("RevitNodes")
import Revit
clr.ImportExtensions(Revit.Elements)
clr.ImportExtensions(Revit.GeometryConversion)
clr.AddReference("RevitServices")
import RevitServices
from RevitServices.Persistence import DocumentManager 
from RevitServices.Transactions import TransactionManager 

clr.AddReference("RevitAPI")
clr.AddReference("RevitAPIUI")

import Autodesk 
from Autodesk.Revit.DB import *
from Autodesk.Revit.DB.Electrical import *
from Autodesk.Revit.UI import *

doc = DocumentManager.Instance.CurrentDBDocument
uiapp = DocumentManager.Instance.CurrentUIApplication 
app = uiapp.Application 
uidoc = uiapp.ActiveUIDocument

def tolist(obj1):
	if isinstance(obj1,(list, tuple, set)): return obj1
	else: return [obj1]

#Preparing input from dynamo to revit
ele = UnwrapElement(IN[0])

#Do some action in a Transaction

TransactionManager.Instance.EnsureInTransaction(doc)

catList = List[BuiltInCategory]()
catList.Add(BuiltInCategory.OST_DuctCurves)
catList.Add(BuiltInCategory.OST_CableTray)
catList.Add(BuiltInCategory.OST_PipeCurves)

catFilter = ElementMulticategoryFilter(catList)

view = doc.ActiveView

bb = ele.get_BoundingBox(None)

ot = Outline(bb.Min, bb.Max)

bbFilter = BoundingBoxIntersectsFilter(ot)

eleFilter = ElementIntersectsElementFilter(ele)

clashes = FilteredElementCollector(doc).WherePasses(catFilter).WherePasses(eleFilter).ToElements()


TransactionManager.Instance.TransactionTaskDone()

OUT = clashes
# ----------------------------------------
