# Dynamo graph Creating Elements.dyn (Dynamo 3.3.0.6316)

python_script = Python()  # CPython3; frozen; unwired: IN[0]
# ---------- python_script.python (63 lines) ----------
import clr

import sys
sys.path.append('C:\Program Files (x86)\IronPython 2.7\Lib')

import System
from System.Collections.Generic import *

clr.AddReference('ProtoGeometry')
from Autodesk.DesignScript.Geometry import *

clr.AddReference("RevitNodes")
import Revit
clr.ImportExtensions(Revit.Elements)
clr.ImportExtensions(Revit.GeometryConversion)
clr.AddReference("RevitServices")
import RevitServices
from RevitServices.Persistence import DocumentManager 
from RevitServices.Transactions import TransactionManager 

clr.AddReference("RevitAPI")
clr.AddReference("RevitAPIUI")

import Autodesk 
from Autodesk.Revit.DB import *
from Autodesk.Revit.UI import *

doc = DocumentManager.Instance.CurrentDBDocument
uiapp = DocumentManager.Instance.CurrentUIApplication 
app = uiapp.Application 
uidoc = uiapp.ActiveUIDocument

def tolist(obj1):
    if isinstance(obj1,(list, tuple, set)): return obj1
    else: return [obj1]

#Preparing input from dynamo to revit
element = UnwrapElement(IN[0])

#Do some action in a Transaction
"""
TransactionManager.Instance.EnsureInTransaction(doc)

beams = FilteredElementCollector(doc).OfCategory(BuiltInCategory.OST_StructuralFraming).WhereElementIsNotElementType().ToElements()

beams_wanted = []
#beams_wanted_length = []

for beam in beams:
    b_len = round(beam.LookupParameter("Length").AsDouble()*304.8)
    if b_len == 1500 or b_len == 1000:
        beams_wanted.append(beam)
        #beams_wanted_length.append(b_len)      


#b_len = beams[1].LookupParameter("Length").AsDouble()*304.8

TransactionManager.Instance.TransactionTaskDone()

"""


OUT = wallLength #beams_wanted_length
# ----------------------------------------
python_script_2 = Python()  # CPython3; unwired: IN[0]
# ---------- python_script_2.python (56 lines) ----------
import clr

import sys
sys.path.append('C:\\Program Files (x86)\\IronPython 2.7\\Lib')

import System
from System.Collections.Generic import *

clr.AddReference('ProtoGeometry')
from Autodesk.DesignScript.Geometry import *

clr.AddReference("RevitNodes")
import Revit
clr.ImportExtensions(Revit.Elements)
clr.ImportExtensions(Revit.GeometryConversion)
clr.AddReference("RevitServices")
import RevitServices
from RevitServices.Persistence import DocumentManager 
from RevitServices.Transactions import TransactionManager 

clr.AddReference("RevitAPI")
clr.AddReference("RevitAPIUI")

import Autodesk 
from Autodesk.Revit.DB import *
from Autodesk.Revit.DB.Electrical import *
from Autodesk.Revit.UI import *

doc = DocumentManager.Instance.CurrentDBDocument
uiapp = DocumentManager.Instance.CurrentUIApplication 
app = uiapp.Application 
uidoc = uiapp.ActiveUIDocument

#Preparing input from dynamo to revit
element = UnwrapElement(IN[0])

#Do some action in a Transaction
TransactionManager.Instance.EnsureInTransaction(doc)

# Collect all wall elements in the document
collector = FilteredElementCollector(doc)
walls = collector.OfClass(Wall).ToElements()

# Find walls with length between 1000 and 1500 mm (converting from feet to mm)
wallLength = []
for wall in walls:
    length_param = wall.LookupParameter("Length")
    if length_param and length_param.AsDouble() is not None:
        length_mm = length_param.AsDouble() * 304.8
        if 1000 < length_mm < 1500:
            wallLength.append(length_mm)


TransactionManager.Instance.TransactionTaskDone()

OUT = wallLength
# ----------------------------------------
byCoordinates = Point.ByCoordinates()
code_block = CodeBlock { 50000; }
byCoordinates_2 = Point.ByCoordinates(x=code_block)
byStartPointEndPoint = Line.ByStartPointEndPoint(startPoint=byCoordinates, endPoint=byCoordinates_2)
wall_types = WallTypes("Stacked_Wall-Partn_12P-70MStd-12P")
wall_creation = Python(IN[0]=byStartPointEndPoint, IN[1]=wall_types)  # CPython3; frozen
# ---------- wall_creation.python (121 lines) ----------
import clr

import sys
sys.path.append('C:\Program Files (x86)\IronPython 2.7\Lib')

import System
from System.Collections.Generic import *

clr.AddReference('ProtoGeometry')
from Autodesk.DesignScript.Geometry import *

clr.AddReference("RevitNodes")
import Revit
clr.ImportExtensions(Revit.Elements)
clr.ImportExtensions(Revit.GeometryConversion)
clr.AddReference("RevitServices")
import RevitServices
from RevitServices.Persistence import DocumentManager 
from RevitServices.Transactions import TransactionManager 

clr.AddReference("RevitAPI")
clr.AddReference("RevitAPIUI")

import Autodesk 
from Autodesk.Revit.DB import *
from Autodesk.Revit.DB.Electrical import *
from Autodesk.Revit.UI import *

doc = DocumentManager.Instance.CurrentDBDocument
uiapp = DocumentManager.Instance.CurrentUIApplication 
app = uiapp.Application 
uidoc = uiapp.ActiveUIDocument

def tolist(obj1):
	if isinstance(obj1,(list, tuple, set)): return obj1
	else: return [obj1]

#Preparing input from dynamo to revit
#dls = tolist(UnwrapElement(IN[0]))

dynLine = IN[0]
wt = UnwrapElement(IN[1])

#Do some action in a Transaction

TransactionManager.Instance.EnsureInTransaction(doc)

"""
public static Wall Create(
    Document document,
    Curve curve,
    ElementId levelId,
    bool structural
)"""



levels = FilteredElementCollector(doc).OfClass(Level).ToElements()   
for level in levels:
    if level.Name == "Level 0":
        level0 = level
        
"""
for dl in dls:
    curve = dl.Location.Curve 
    newWall = Wall.Create(doc, curve, level0.Id, False)
"""

rvtLine = dynLine.ToRevitType()

#newWall = Wall.Create(doc, rvtLine, level0.Id, False)





"""
public static Wall Create(
    Document document,
    Curve curve,
    ElementId wallTypeId,
    ElementId levelId,
    double height,
    double offset,
    bool flip,
    bool structural
)"""

levels = FilteredElementCollector(doc).OfClass(Level).ToElements()   
for level in levels:
    if level.Name == "Level 0":
        level0 = level
    if level.Name == "Level 1":
        level1 = level

rvtLine = dynLine.ToRevitType()


wallTypes = FilteredElementCollector(doc).OfClass(WallType).ToElements()

for wallType in wallTypes:
    if wallType.LookupParameter("Type Name").AsString() == "Concrete Wall":
        cw = wallType


newWall = Wall.Create(doc, rvtLine, wt.Id, level0.Id, 3500/304.8, -500/304.8, False, True)



newWall.LookupParameter("Top Constraint").Set(level1.Id)








TransactionManager.Instance.TransactionTaskDone()

OUT = newWall
# ----------------------------------------
select_model_element = DSModelElementSelection()  # 1 picked in the model
select_model_elements = DSModelElementsSelection()  # 6 picked in the model
select_model_element_2 = DSModelElementSelection()  # 1 picked in the model
python_script_3 = Python(IN[0]=select_model_element_2)  # CPython3
# ---------- python_script_3.python (66 lines) ----------
import clr

import sys
sys.path.append('C:\Program Files (x86)\IronPython 2.7\Lib')

import System
from System.Collections.Generic import *

clr.AddReference('ProtoGeometry')
from Autodesk.DesignScript.Geometry import *

clr.AddReference("RevitNodes")
import Revit
clr.ImportExtensions(Revit.Elements)
clr.ImportExtensions(Revit.GeometryConversion)
clr.AddReference("RevitServices")
import RevitServices
from RevitServices.Persistence import DocumentManager 
from RevitServices.Transactions import TransactionManager 

clr.AddReference("RevitAPI")
clr.AddReference("RevitAPIUI")

import Autodesk 
from Autodesk.Revit.DB import *
from Autodesk.Revit.DB.Structure import *
from Autodesk.Revit.DB.Electrical import *
from Autodesk.Revit.UI import *

doc = DocumentManager.Instance.CurrentDBDocument
uiapp = DocumentManager.Instance.CurrentUIApplication 
app = uiapp.Application 
uidoc = uiapp.ActiveUIDocument

def tolist(obj1):
	if isinstance(obj1,(list, tuple, set)): return obj1
	else: return [obj1]

#Preparing input from dynamo to revit
dl = UnwrapElement(IN[0])

#Do some action in a Transaction

TransactionManager.Instance.EnsureInTransaction(doc)

"""
public FamilyInstance NewFamilyInstance(
    XYZ location,
    FamilySymbol symbol,
    StructuralType structuralType
)"""

point = dl.Location.Curve.Center

furnitureTypes = FilteredElementCollector(doc).OfCategory(BuiltInCategory.OST_Furniture).WhereElementIsElementType().ToElements()

for ft in furnitureTypes:
    if ft.LookupParameter("Type Name").AsString() == "1525x762mm":
        myType = ft

newFurniture = doc.Create.NewFamilyInstance(point, myType,  0)#StructuralType.NonStructural)


TransactionManager.Instance.TransactionTaskDone()

OUT = newFurniture
# ----------------------------------------
