# Dynamo graph Document Opening.dyn (Dynamo 3.3.0.6316)

python_script = Python()  # CPython3; frozen; unwired: IN[0]
# ---------- python_script.python (85 lines) ----------
import clr

import sys
sys.path.append('C:\Program Files (x86)\IronPython 2.7\Lib')

import System
from System.Collections.Generic import *

clr.AddReference('ProtoGeometry')
from Autodesk.DesignScript.Geometry import *

clr.AddReference("RevitNodes")
import Revit
clr.ImportExtensions(Revit.Elements)
clr.ImportExtensions(Revit.GeometryConversion)
clr.AddReference("RevitServices")
import RevitServices
from RevitServices.Persistence import DocumentManager 
from RevitServices.Transactions import TransactionManager 

clr.AddReference("RevitAPI")
clr.AddReference("RevitAPIUI")

import Autodesk 
from Autodesk.Revit.DB import *
from Autodesk.Revit.DB.Mechanical import *
from Autodesk.Revit.DB.Electrical import *
from Autodesk.Revit.UI import *

doc = DocumentManager.Instance.CurrentDBDocument
uiapp = DocumentManager.Instance.CurrentUIApplication 
app = uiapp.Application 
uidoc = uiapp.ActiveUIDocument

def tolist(obj1):
    if isinstance(obj1,(list, tuple, set)): return obj1
    else: return [obj1]

#Preparing input from dynamo to revit
element = UnwrapElement(IN[0])

#Do some action in a Transaction

filePath = r"C:\Users\Akryazz\OneDrive\Documents\My Files\Revit Api Training\Python Revit API Training\Revit Models\2025\MEP Model.rvt"

newDoc = app.OpenDocumentFile(filePath)


TransactionManager.Instance.EnsureInTransaction(newDoc)

ducts = FilteredElementCollector(newDoc).OfClass(Duct).ToElements()

values = []

for duct in ducts:
    param = duct.LookupParameter("Comments")
    paramValue = param.AsString()
    param.Set("Dr.Doom")
    values.append(paramValue)

TransactionManager.Instance.ForceCloseTransaction()

newDoc.Save()



"""
public void Export(
    string folder,
    string name,
    NavisworksExportOptions options
)

exportFolderPath = r"C:\Users\Akryazz\Downloads\Exports"

nwcOpt = NavisworksExportOptions()

nwcName = "Melody.nwc"


doc.Export(exportFolderPath, nwcName, nwcOpt)
"""


OUT = ""
# ----------------------------------------
python_script_2 = Python()  # CPython3; frozen; unwired: IN[0]
# ---------- python_script_2.python (79 lines) ----------
import clr

import sys
sys.path.append('C:\Program Files (x86)\IronPython 2.7\Lib')

import System
from System.Collections.Generic import *

clr.AddReference('ProtoGeometry')
from Autodesk.DesignScript.Geometry import *

clr.AddReference("RevitNodes")
import Revit
clr.ImportExtensions(Revit.Elements)
clr.ImportExtensions(Revit.GeometryConversion)
clr.AddReference("RevitServices")
import RevitServices
from RevitServices.Persistence import DocumentManager 
from RevitServices.Transactions import TransactionManager 

clr.AddReference("RevitAPI")
clr.AddReference("RevitAPIUI")

import Autodesk 
from Autodesk.Revit.DB import *
from Autodesk.Revit.DB.Mechanical import *
from Autodesk.Revit.DB.Electrical import *
from Autodesk.Revit.UI import *

doc = DocumentManager.Instance.CurrentDBDocument
uiapp = DocumentManager.Instance.CurrentUIApplication 
app = uiapp.Application 
uidoc = uiapp.ActiveUIDocument

def tolist(obj1):
	if isinstance(obj1,(list, tuple, set)): return obj1
	else: return [obj1]

#Preparing input from dynamo to revit
filaPaths = UnwrapElement(IN[0])

"""
#filePath = r"C:\Users\Akryazz\OneDrive\Documents\My Files\Revit Api Training\Python Revit API Training\Revit Models\2025\MEP Model.rvt"

newDoc = app.OpenDocumentFile(filePath)


TransactionManager.Instance.EnsureInTransaction(newDoc)


ducts = FilteredElementCollector(newDoc).OfClass(Duct).ToElements()

values = []

for duct in ducts:
    param = duct.LookupParameter("Comments")
    paramValue = param.AsString()
    param.Set("Dr.Doom")
    values.append(paramValue)

TransactionManager.Instance.ForceCloseTransaction()
"""

for filePath in filePaths:
    newDoc = app.OpenDocumentFile(filePath)
    exportFolderPath = r"C:\Users\Akryazz\Downloads\Exports"
    
    nwcOpt = NavisworksExportOptions()
    
    nwcName = newDoc.Title+".nwc"

    newDoc.Export(exportFolderPath, nwcName, nwcOpt)



#newDoc.Save()


OUT = ""
# ----------------------------------------
file_path = Filename("..\..\..\..\OneDrive\Documents\My Files\Revit Api Training\Python Revit API Training\Revit Models\2025\MEP Model.rvt")
file_path_2 = Filename("..\..\..\..\OneDrive\Documents\My Files\Revit Api Training\Python Revit API Training\Revit Models\2025\RoomModel.rvt")
file_path_3 = Filename("..\..\..\..\OneDrive\Documents\My Files\Revit Api Training\Python Revit API Training\Revit Models\2025\SpaceModel.rvt")
list_create = List.Create(item0=file_path, item1=file_path_2, item2=file_path_3)
python_script_3 = Python(IN[0]=list_create)  # CPython3; frozen
# ---------- python_script_3.python (55 lines) ----------
import clr

import sys
sys.path.append(r'C:\Program Files (x86)\IronPython 2.7\Lib')

import System
from System.Collections.Generic import *

clr.AddReference('ProtoGeometry')
from Autodesk.DesignScript.Geometry import *

clr.AddReference("RevitNodes")
import Revit
clr.ImportExtensions(Revit.Elements)
clr.ImportExtensions(Revit.GeometryConversion)
clr.AddReference("RevitServices")
import RevitServices
from RevitServices.Persistence import DocumentManager 
from RevitServices.Transactions import TransactionManager 

clr.AddReference("RevitAPI")
clr.AddReference("RevitAPIUI")

import Autodesk 
from Autodesk.Revit.DB import *
from Autodesk.Revit.DB.Electrical import *
from Autodesk.Revit.UI import *

doc = DocumentManager.Instance.CurrentDBDocument
uiapp = DocumentManager.Instance.CurrentUIApplication 
app = uiapp.Application 
uidoc = uiapp.ActiveUIDocument

def tolist(obj1):
	if isinstance(obj1,(list, tuple, set)): return obj1
	else: return [obj1]

#Preparing input from dynamo to revit
filePaths = UnwrapElement(IN[0])


for filePath in filePaths:
    newDoc = app.OpenDocumentFile(filePath)
    exportFolderPath = r"C:\Users\Akryazz\Downloads\Exports"
    
    nwcOpt = NavisworksExportOptions()
    
    nwcName = newDoc.Title+".nwc"

    newDoc.Export(exportFolderPath, nwcName, nwcOpt)




OUT = filePaths[0]
# ----------------------------------------
python_script_4 = Python()  # CPython3; unwired: IN[0]
# ---------- python_script_4.python (73 lines) ----------
import clr

import sys
sys.path.append('C:\Program Files (x86)\IronPython 2.7\Lib')

import System
from System.Collections.Generic import *

clr.AddReference('ProtoGeometry')
from Autodesk.DesignScript.Geometry import *

clr.AddReference("RevitNodes")
import Revit
clr.ImportExtensions(Revit.Elements)
clr.ImportExtensions(Revit.GeometryConversion)
clr.AddReference("RevitServices")
import RevitServices
from RevitServices.Persistence import DocumentManager 
from RevitServices.Transactions import TransactionManager 

clr.AddReference("RevitAPI")
clr.AddReference("RevitAPIUI")

import Autodesk 
from Autodesk.Revit.DB import *
from Autodesk.Revit.DB.Electrical import *
from Autodesk.Revit.UI import *

doc = DocumentManager.Instance.CurrentDBDocument
uiapp = DocumentManager.Instance.CurrentUIApplication 
app = uiapp.Application 
uidoc = uiapp.ActiveUIDocument

def tolist(obj1):
	if isinstance(obj1,(list, tuple, set)): return obj1
	else: return [obj1]

#Preparing input from dynamo to revit
element = UnwrapElement(IN[0])

#Do some action in a Transaction

filePath = r"C:\Users\Akryazz\OneDrive\Documents\My Files\Revit Api Training\Python Revit API Training\Revit Models\2025\Elec-Workshared.rvt"

mp = FilePath(filePath)

openOpt = OpenOptions()

newDoc = app.OpenDocumentFile(mp, openOpt)

cts = FilteredElementCollector(newDoc).OfClass(CableTray).ToElements()

TransactionManager.Instance.EnsureInTransaction(newDoc)

values = []

for ct in cts:
    param = ct.LookupParameter("Comments")
    paramValue = param.AsString()
    values.append(paramValue)
    param.Set("CJP")
    

TransactionManager.Instance.ForceCloseTransaction()

syncOpt = SynchronizeWithCentralOptions()
tranOpt = TransactWithCentralOptions()

newDoc.SynchronizeWithCentral(tranOpt, syncOpt)

newDoc.Close()

OUT = values
# ----------------------------------------
