# Dynamo graph Dynamo copilot learnings.dyn (Dynamo 3.3.0.6316)

select_model_element = DSModelElementSelection()  # 1 picked in the model
adithya_code = Python(IN[0]=select_model_element)  # CPython3; frozen
# ---------- adithya_code.python (71 lines) ----------
import clr

import sys
sys.path.append('C:\Program Files (x86)\IronPython 2.7\Lib')

import System
from System.Collections.Generic import *

clr.AddReference('ProtoGeometry')
from Autodesk.DesignScript.Geometry import *

clr.AddReference("RevitNodes")
import Revit
clr.ImportExtensions(Revit.Elements)
clr.ImportExtensions(Revit.GeometryConversion)
clr.AddReference("RevitServices")
import RevitServices
from RevitServices.Persistence import DocumentManager 
from RevitServices.Transactions import TransactionManager 

clr.AddReference("RevitAPI")
clr.AddReference("RevitAPIUI")

import Autodesk 
from Autodesk.Revit.DB import *
from Autodesk.Revit.UI import *

doc = DocumentManager.Instance.CurrentDBDocument
uiapp = DocumentManager.Instance.CurrentUIApplication 
app = uiapp.Application 
uidoc = uiapp.ActiveUIDocument

def tolist(obj1):
    if isinstance(obj1,(list, tuple, set)): return obj1
    else: return [obj1]

#Preparing input from dynamo to revit
walls = tolist(UnwrapElement(IN[0]))

#Do some action in a Transaction

TransactionManager.Instance.EnsureInTransaction(doc)

wallparvalues = []


for wall in walls:
    wallpar = wall.LookupParameter("Comments")
    wallparval = wallpar.AsString()
    wallparvalues.append(wallparval)
    #wallpar.Set("It is confirmed")
    
    walltypid = wall.GetTypeId()
    walltyp = doc.GetElement(walltypid)
    wtpar = walltyp.LookupParameter("Type Comments")
    wtparval = wtpar.AsString()
    wallparvalues.append(wtparval)
   #wtparset = wtpar.Set("Tower A")


paramNames = []

for wall in walls:
    par = wall.Parameters
    for p in par:
        paramNames.append(p.Definition.Name)


TransactionManager.Instance.TransactionTaskDone()

OUT = wallparvalues #wtparval
# ----------------------------------------
select_model_elements = DSModelElementsSelection()  # 3 picked in the model
wall_types = WallTypes("Wall-Site_215Bwk_w-Footing")
python_script = Python(IN[0]=select_model_elements, IN[1]=wall_types)  # CPython3; frozen
# ---------- python_script.python (65 lines) ----------
import clr

import sys
sys.path.append('C:\Program Files (x86)\IronPython 2.7\Lib')

import System
from System.Collections.Generic import *

clr.AddReference('ProtoGeometry')
from Autodesk.DesignScript.Geometry import *

clr.AddReference("RevitNodes")
import Revit
clr.ImportExtensions(Revit.Elements)
clr.ImportExtensions(Revit.GeometryConversion)
clr.AddReference("RevitServices")
import RevitServices
from RevitServices.Persistence import DocumentManager 
from RevitServices.Transactions import TransactionManager 

clr.AddReference("RevitAPI")
clr.AddReference("RevitAPIUI")

import Autodesk 
from Autodesk.Revit.DB import *
from Autodesk.Revit.UI import *

doc = DocumentManager.Instance.CurrentDBDocument
uiapp = DocumentManager.Instance.CurrentUIApplication 
app = uiapp.Application 
uidoc = uiapp.ActiveUIDocument

def tolist(obj1):
	if isinstance(obj1,(list, tuple, set)): return obj1
	else: return [obj1]

#Preparing input from dynamo to revit
elements = UnwrapElement(IN[0])

wallType = UnwrapElement(IN[1])

#Do some action in a Transaction

TransactionManager.Instance.EnsureInTransaction(doc)

"""
for element in elements:
    tcId = element.GetTypeId()
    tc = doc.GetElement(tcId)
    c1 = tc.LookupParameter("Type Comments").AsString()
    
    a1 = element.LookupParameter("Unconnected Height").AsDouble()*304.8
    
    cleanValue = round(a1,2)
    
    c2 = element.LookupParameter("Comments")
    c2.Set(str(cleanValue))
    
"""



TransactionManager.Instance.TransactionTaskDone()

OUT = wallType.LookupParameter("Type Comments").AsString()
# ----------------------------------------
select_model_element_2 = DSModelElementSelection()  # 1 picked in the model
python_script_2 = Python(IN[0]=select_model_element_2)  # CPython3; frozen
# ---------- python_script_2.python (50 lines) ----------
# Standard Dynamo Python Script template
import clr

clr.AddReference('RevitAPI')
clr.AddReference('RevitAPIUI')
clr.AddReference('RevitServices')
clr.AddReference('RevitNodes') # Contains Revit.Elements and ElementWrapper

from Autodesk.Revit.DB import *
from RevitServices.Persistence import DocumentManager
from RevitServices.Transactions import TransactionManager

# Explicitly import ElementWrapper and its UnwrapElement method
# This is the most reliable method when direct import fails
import Revit
clr.ImportExtensions(Revit.Elements) # This makes .ToDSType(bool) and .InternalElement available
# However, for unwrapping, ElementWrapper.UnwrapElement is more direct

doc = DocumentManager.Instance.CurrentDBDocument
uidoc = DocumentManager.Instance.CurrentUIApplication.ActiveUIDocument

# Inputs from connected nodes
# IN[0] expects a single Wall element
input_wall = IN[0]

workset_name = "Workset Not Found"

if input_wall is not None:
    # Use ElementWrapper.UnwrapElement to get the native Revit Element
    # This method is generally very reliable for unwrapping Dynamo elements
    wall = input_wall.InternalElement # This is the most direct way to get the internal Revit API element from a Dynamo wrapper.
    
    if wall is not None:
        # Get the WorksetId of the wall
        workset_id = wall.WorksetId
        
        # Verify the document is workshared and the WorksetId is valid
        if doc.IsWorkshared and workset_id != WorksetId.InvalidWorksetId:
            workset_table = doc.GetWorksetTable()
            if workset_table:
                workset = workset_table.GetWorkset(workset_id)
                if workset is not None:
                    workset_name = workset.Name
        else:
            workset_name = "Non-Workshared Document or Invalid WorksetId"
    else:
        workset_name = "Input element could not be unwrapped."

# Output must be assigned to OUT
OUT = workset_name
# ----------------------------------------
select_model_elements_2 = DSModelElementsSelection()  # 3 picked in the model
code_block = CodeBlock { [320697, 320638]; }
karthik_code = Python(IN[0]=code_block)  # CPython3
# ---------- karthik_code.python (49 lines) ----------
# Standard Dynamo Python Script template
import clr

clr.AddReference('RevitAPI')
clr.AddReference('RevitAPIUI')
clr.AddReference('RevitServices')
clr.AddReference('RevitNodes')

from Autodesk.Revit.DB import *
from Autodesk.Revit.UI import *
from RevitServices.Persistence import DocumentManager

# Inputs from connected nodes are available via IN list
# IN[0]: List of element ID integers
input_ids = IN[0]

doc = DocumentManager.Instance.CurrentDBDocument
uidoc = DocumentManager.Instance.CurrentUIApplication.ActiveUIDocument

success = False

if uidoc and input_ids is not None:
    # Ensure input is treated as a list
    if not isinstance(input_ids, list):
        input_ids = [input_ids]
        
    try:
        # Convert integer list to Revit ElementId objects
        element_ids = []
        for id_int in input_ids:
            if isinstance(id_int, int) or str(id_int).isdigit():
                element_ids.append(ElementId(int(id_int)))
        
        # Select the elements in the UI
        # System.Collections.Generic.List is required for SetElementIds in Revit API
        import System
        from System.Collections.Generic import List
        
        id_list = List[ElementId](element_ids)
        uidoc.Selection.SetElementIds(id_list)
        
        # Refresh the active view to display the selection
        uidoc.RefreshActiveView()
        success = True
    except Exception:
        success = False

# Output must be assigned to OUT
OUT = success
# ----------------------------------------
