# Dynamo graph Element Modifications.dyn (Dynamo 3.3.0.6316)

select_model_element = DSModelElementSelection()  # 1 picked in the model
select_model_element_2 = DSModelElementSelection()  # 1 picked in the model
python_script = Python(IN[0]=select_model_element, IN[1]=select_model_element_2)  # CPython3
# ---------- python_script.python (116 lines) ----------
import clr

import sys
sys.path.append('C:\Program Files (x86)\IronPython 2.7\Lib')

import System
from System.Collections.Generic import *

clr.AddReference('ProtoGeometry')
from Autodesk.DesignScript.Geometry import *

clr.AddReference("RevitNodes")
import Revit
clr.ImportExtensions(Revit.Elements)
clr.ImportExtensions(Revit.GeometryConversion)
clr.AddReference("RevitServices")
import RevitServices
from RevitServices.Persistence import DocumentManager 
from RevitServices.Transactions import TransactionManager 

clr.AddReference("RevitAPI")
clr.AddReference("RevitAPIUI")

import Autodesk 
from Autodesk.Revit.DB import *
from Autodesk.Revit.DB.Electrical import *
from Autodesk.Revit.UI import *

doc = DocumentManager.Instance.CurrentDBDocument
uiapp = DocumentManager.Instance.CurrentUIApplication 
app = uiapp.Application 
uidoc = uiapp.ActiveUIDocument

def tolist(obj1):
	if isinstance(obj1,(list, tuple, set)): return obj1
	else: return [obj1]

#Preparing input from dynamo to revit
ele = UnwrapElement(IN[0])
dl = UnwrapElement(IN[1])

#Do some action in a Transaction

TransactionManager.Instance.EnsureInTransaction(doc)
"""
i = 1

while i <= 5:  
    vec = XYZ(i*5000/304.8, 0, 0)  
    ElementTransformUtils.CopyElement(doc, ele.Id, vec)
    i = i + 1
"""

"""
for i in range(1, 6):
    vec = XYZ(i*5000/304.8, 0, 0)  
    ElementTransformUtils.CopyElement(doc, ele.Id, vec)
"""

"""
public static void MoveElement(
    Document document,
    ElementId elementToMove,
    XYZ translation
)"""

#vec = XYZ(5000/304.8, 0, 0)  
#ElementTransformUtils.MoveElement(doc, ele.Id, vec)

"""
center = arc.Location.Curve.Center

ele.Location.Point = center
"""

"""
public static void RotateElement(
    Document document,
    ElementId elementToRotate,
    Line axis,
    double angle
)"""

"""

corner = ele.Location.Point

endPoint = XYZ(corner.X, corner.Y, corner.Z + 10)

axis = Line.CreateBound(corner, endPoint)

ElementTransformUtils.RotateElement(doc, ele.Id, axis, 45*0.0174533)

"""

"""
public static void MirrorElement(
    Document document,
    ElementId elementToMirror,
    Plane plane
)"""


origin = dl.Location.Curve.GetEndPoint(0)

normal = XYZ(1,0,0)

plane = Plane.CreateByNormalAndOrigin(normal, origin)


ElementTransformUtils.MirrorElement(doc, ele.Id, plane)


TransactionManager.Instance.TransactionTaskDone()

OUT = plane
# ----------------------------------------
