# Dynamo graph Exports.dyn (Dynamo 3.3.0.6316)

ronak_s_code = Python()  # CPython3; frozen; unwired: IN[0]
# ---------- ronak_s_code.python (78 lines) ----------
import clr

import sys
sys.path.append('C:\Program Files (x86)\IronPython 2.7\Lib')

import System
from System.Collections.Generic import *

clr.AddReference('ProtoGeometry')
from Autodesk.DesignScript.Geometry import *

clr.AddReference("RevitNodes")
import Revit
clr.ImportExtensions(Revit.Elements)
clr.ImportExtensions(Revit.GeometryConversion)
clr.AddReference("RevitServices")
import RevitServices
from RevitServices.Persistence import DocumentManager 
from RevitServices.Transactions import TransactionManager 

clr.AddReference("RevitAPI")
clr.AddReference("RevitAPIUI")

import Autodesk 
from Autodesk.Revit.DB import *
from Autodesk.Revit.DB.Electrical import *
from Autodesk.Revit.UI import *

doc = DocumentManager.Instance.CurrentDBDocument
uiapp = DocumentManager.Instance.CurrentUIApplication 
app = uiapp.Application 
uidoc = uiapp.ActiveUIDocument

def tolist(obj1):
	if isinstance(obj1,(list, tuple, set)): return obj1
	else: return [obj1]

#Preparing input from dynamo to revit
element = UnwrapElement(IN[0])

#Do some action in a Transaction

TransactionManager.Instance.EnsureInTransaction(doc)

links = FilteredElementCollector(doc).OfClass(RevitLinkInstance).ToElements()
temp = []
for link in links:
    linkdoc = link.GetLinkDocument()
    if linkdoc.Title == "Project1":
        mepdoc = linkdoc
        temp.append(mepdoc)
ducts = FilteredElementCollector(mepdoc).OfClass(Duct).ToElements()
values =[]
for duct in ducts:
    type_id = duct.GetTypeId()
    elementType = mepdoc.GetElement(type_id)
    type_Param = elementType.LookupParameter("Roughness").AsDouble()*304.8
    values.append(type_Param)
walls = FilteredElementCollector(doc).OfClass(Wall).ToElements()
link_elements = List[BuiltInCategory]()
link_elements.Add(BuiltInCategory.OST_DuctCurves)
link_elements.Add(BuiltInCategory.OST_PipeCurves)
multiFilt = ElementMulticategoryFilter(link_elements)
test = []
for wall in walls:
    bb = wall.get_BoundingBox(None)
    bbFilt = BoundingBoxIntersectsFilter(Outline(bb.Min, bb.Max))
    geo = wall.get_Geometry(Options())
    solids = list(geo)[0]
    solidFilt = ElementIntersectsSolidFilter(solids)
    clashes = FilteredElementCollector(mepdoc).WherePasses(multiFilt).WherePasses(bbFilt).WherePasses(solidFilt).ToElements()
    if len(clashes) > 0:
        test.append(clashes)


TransactionManager.Instance.TransactionTaskDone()

OUT = element
# ----------------------------------------
adithya = Python()  # CPython3; frozen; unwired: IN[0]
# ---------- adithya.python (125 lines) ----------
# ==========================
# IMPORTS
# ==========================

import clr
import sys

sys.path.append('C:\Program Files (x86)\IronPython 2.7\Lib')

import System
from System.Collections.Generic import *

clr.AddReference('ProtoGeometry')
from Autodesk.DesignScript.Geometry import *

clr.AddReference("RevitNodes")
import Revit
clr.ImportExtensions(Revit.Elements)
clr.ImportExtensions(Revit.GeometryConversion)
clr.AddReference("RevitServices")
import RevitServices
from RevitServices.Persistence import DocumentManager 
from RevitServices.Transactions import TransactionManager 

clr.AddReference("RevitAPI")
clr.AddReference("RevitAPIUI")

import Autodesk 
from Autodesk.Revit.DB import *
from Autodesk.Revit.DB.Mechanical import *
from Autodesk.Revit.DB.Electrical import *
from Autodesk.Revit.DB.Plumbing import *

from Autodesk.Revit.UI import *

# ==========================
# DOCUMENTS
# ==========================

doc = DocumentManager.Instance.CurrentDBDocument
uiapp = DocumentManager.Instance.CurrentUIApplication 
app = uiapp.Application 
uidoc = uiapp.ActiveUIDocument

def tolist(obj1):
    if isinstance(obj1,(list, tuple, set)): return obj1
    else: return [obj1]
# ==========================
# INPUTS
# ==========================

element = UnwrapElement(IN[0])

# ==========================
# CODE
# ==========================

TransactionManager.Instance.EnsureInTransaction(doc)

revitLinks = FilteredElementCollector(doc).OfClass(RevitLinkInstance).ToElements()

for revitLink in revitLinks:
    linkdoc = revitLink.GetLinkDocument()
    if linkdoc.Title == "MEP Model":
        mepdoc = linkdoc
        
"""
ducts = FilteredElementCollector(mepdoc).OfClass(Duct).ToElements()
typemarks = []
for duct in ducts:
    typId = duct.GetTypeId()
    ductType = mepdoc.GetElement(typId)
    param = ductType.LookupParameter("Type Comments").AsString()
    typemarks.append(param)
 """  

walls = FilteredElementCollector(doc).OfClass(Wall).ToElements()


viewFamilyTypes = FilteredElementCollector(doc).OfClass(ViewFamilyType).ToElements()

for viewFamilyType in viewFamilyTypes:
    if viewFamilyType.LookupParameter("Type Name").AsString() == "3D View":
        viewtype = viewFamilyType
        
classList = List[System.Type]()
classList.Add(Duct)
classList.Add(CableTray)
classList.Add(Pipe)

classFilter = ElementMulticlassFilter(classList)

clashes = []
clashNumber = 1
extent = 500/304.8

for wall in walls:
    bb = wall.get_BoundingBox(None)
    bbo  =BoundingBoxIntersectsFilter(Outline(bb.Min, bb.Max))
    solid = wall.get_Geometry(Options())
    solidli = list(solid)[0]
    sfilter = ElementIntersectsSolidFilter(solidli)
    clash = FilteredElementCollector(mepdoc).WherePasses(classFilter).WherePasses(bbo).WherePasses(sfilter).ToElements()
    if len(clash)>0:
        clashView = View3D.CreateIsometric(doc, viewtype.Id)
        clashView.Name = "Clash View " +str(clashNumber)+"_"+ str(len(clash)) + "No's"
        clashView.DetailLevel = ViewDetailLevel.Fine  
        minX = bb.Min.X-extent
        minY = bb.Min.Y-extent
        minZ = bb.Min.Z-extent
        maxX = bb.Max.X+extent
        maxY = bb.Max.Y+extent
        maxZ = bb.Max.Z+extent
        newbb = BoundingBoxXYZ()
        newbb.Min = XYZ(minX, minY, minZ)
        newbb.Max = XYZ(maxX, maxY, maxZ)
        clashView.SetSectionBox(newbb)
        clashes.append([wall, clash])
        clashNumber = clashNumber+1

TransactionManager.Instance.TransactionTaskDone()
# ==========================
# OUTPUT
# ==========================
OUT = clashes
# ----------------------------------------
pdf_set_name = StringInput("Test")  # graph input
dwg_set_name = StringInput("Test")  # graph input
python_script = Python(IN[0]=pdf_set_name, IN[1]=dwg_set_name)  # CPython3
# ---------- python_script.python (125 lines) ----------
import clr

import sys
sys.path.append('C:\Program Files (x86)\IronPython 2.7\Lib')

import System
from System.Collections.Generic import *

clr.AddReference('ProtoGeometry')
from Autodesk.DesignScript.Geometry import *

clr.AddReference("RevitNodes")
import Revit
clr.ImportExtensions(Revit.Elements)
clr.ImportExtensions(Revit.GeometryConversion)
clr.AddReference("RevitServices")
import RevitServices
from RevitServices.Persistence import DocumentManager 
from RevitServices.Transactions import TransactionManager 

clr.AddReference("RevitAPI")
clr.AddReference("RevitAPIUI")

import Autodesk 
from Autodesk.Revit.DB import *
from Autodesk.Revit.DB.Electrical import *
from Autodesk.Revit.UI import *

doc = DocumentManager.Instance.CurrentDBDocument
uiapp = DocumentManager.Instance.CurrentUIApplication 
app = uiapp.Application 
uidoc = uiapp.ActiveUIDocument

def tolist(obj1):
	if isinstance(obj1,(list, tuple, set)): return obj1
	else: return [obj1]

#Preparing input from dynamo to revit
element = UnwrapElement(IN[0])

#Do some action in a Transaction

TransactionManager.Instance.EnsureInTransaction(doc)


"""
public bool Export(
    string folder,
    IList<ElementId> viewIds,
    PDFExportOptions options
)"""

folderPath = r"C:\Users\Akryazz\Downloads\Exports"

sheets = FilteredElementCollector(doc).OfClass(ViewSheet).ToElements()

sh = sheets[0]


pdfOpt = PDFExportOptions()

pdfOpt.AlwaysUseRaster = True
pdfOpt.ColorDepth = ColorDepthType.Color
pdfOpt.Combine = False
pdfOpt.ExportQuality = PDFExportQualityType.DPI4000
pdfOpt.HideCropBoundaries = True
pdfOpt.HideReferencePlane = True
pdfOpt.HideScopeBoxes = True
pdfOpt.HideUnreferencedViewTags = True
pdfOpt.MaskCoincidentLines = True
pdfOpt.PaperPlacement = PaperPlacementType.Center
#pdfOpt.PaperFormat = ExportPaperFormat.
pdfOpt.PaperOrientation = PageOrientationType.Auto
pdfOpt.RasterQuality = RasterQualityType.High
pdfOpt.ReplaceHalftoneWithThinLines = True
pdfOpt.ViewLinksInBlue = False
pdfOpt.ZoomType = ZoomType.FitToPage
pdfOpt.Combine = True

setName = IN[0]

sets = FilteredElementCollector(doc).OfClass(ViewSheetSet).ToElements()


#-----PDF------

for set in sets:
    if set.Name == setName:
        mySet = set

for mySheet in mySet.OrderedViewList :
    viewIdList = List[ElementId]()
    viewIdList.Add(mySheet.Id)
    pdfOpt.FileName =  "CombinedPdf"     
    #doc.Export(folderPath, viewIdList, pdfOpt)



#------DWG----

dwgSetName = IN[1]

for set in sets:
    if set.Name == dwgSetName:
        myDwgSet = set

dwgOpt = DWGExportOptions()


for mySheet in myDwgSet.OrderedViewList :
    viewIdList = List[ElementId]()
    viewIdList.Add(mySheet.Id)
    dwgName = mySheet.SheetNumber + "-" + mySheet.Name
    #doc.Export(folderPath, dwgName, viewIdList, dwgOpt)
    

import os

folder_name = folderPath + "\\" + "new_folder"

os.mkdir(folder_name)

TransactionManager.Instance.TransactionTaskDone()

OUT = folder_name
# ----------------------------------------
