# Dynamo graph FEC 2.dyn (Dynamo 3.3.0.6316)

python_script = Python()  # CPython3; unwired: IN[0]
# ---------- python_script.python (93 lines) ----------
import clr

import sys
sys.path.append('C:\Program Files (x86)\IronPython 2.7\Lib')

import System
from System.Collections.Generic import *

clr.AddReference('ProtoGeometry')
from Autodesk.DesignScript.Geometry import *

clr.AddReference("RevitNodes")
import Revit
clr.ImportExtensions(Revit.Elements)
clr.ImportExtensions(Revit.GeometryConversion)
clr.AddReference("RevitServices")
import RevitServices
from RevitServices.Persistence import DocumentManager 
from RevitServices.Transactions import TransactionManager 

clr.AddReference("RevitAPI")
clr.AddReference("RevitAPIUI")

import Autodesk 
from Autodesk.Revit.DB import *
from Autodesk.Revit.DB.Mechanical import *
from Autodesk.Revit.DB.Electrical import *
from Autodesk.Revit.UI import *

doc = DocumentManager.Instance.CurrentDBDocument
uiapp = DocumentManager.Instance.CurrentUIApplication 
app = uiapp.Application 
uidoc = uiapp.ActiveUIDocument

def tolist(obj1):
	if isinstance(obj1,(list, tuple, set)): return obj1
	else: return [obj1]

#Preparing input from dynamo to revit
element = UnwrapElement(IN[0])

#Do some action in a Transaction

TransactionManager.Instance.EnsureInTransaction(doc)

fec = FilteredElementCollector(doc)

walls = FilteredElementCollector(doc).OfClass(Wall).ToElements()

ducts = FilteredElementCollector(doc).OfClass(Duct).ToElements()

cpValues = []
for wall in walls: cpValues.append(wall.Name)   
     
    
names = [i.LookupParameter("Comments").AsString()  for i in walls]


activeView = doc.ActiveView

wallsInCurrentView = FilteredElementCollector(doc, activeView.Id).OfClass(Wall).ToElements()


catList = List[BuiltInCategory]()
catList.Add(BuiltInCategory.OST_Walls)
catList.Add(BuiltInCategory.OST_DuctCurves)
catList.Add(BuiltInCategory.OST_CableTray)


catFilt = ElementMulticategoryFilter(catList)


fec = FilteredElementCollector(doc).WherePasses(catFilt).WhereElementIsNotElementType().ToElements()

allLevels = FilteredElementCollector(doc).OfClass(Level).ToElements()

level0 = None

for level in allLevels:
    if level.Name == "Level 0":
        level0 = level


levelFilt = ElementLevelFilter(level0.Id)


fec2 = FilteredElementCollector(doc).WherePasses(levelFilt).WherePasses(catFilt).ToElements()



TransactionManager.Instance.TransactionTaskDone()

OUT = fec2
# ----------------------------------------
