# Dynamo graph FEC 4 & Geometry Conversions.dyn (Dynamo 3.3.0.6316)

fec_samples = Python()  # CPython3; frozen; unwired: IN[0]
# ---------- fec_samples.python (83 lines) ----------
import clr

import sys
sys.path.append('C:\Program Files (x86)\IronPython 2.7\Lib')

import System
from System.Collections.Generic import *

clr.AddReference('ProtoGeometry')
from Autodesk.DesignScript.Geometry import *

clr.AddReference("RevitNodes")
import Revit
clr.ImportExtensions(Revit.Elements)
clr.ImportExtensions(Revit.GeometryConversion)
clr.AddReference("RevitServices")
import RevitServices
from RevitServices.Persistence import DocumentManager 
from RevitServices.Transactions import TransactionManager 

clr.AddReference("RevitAPI")
clr.AddReference("RevitAPIUI")

import Autodesk 
from Autodesk.Revit.DB import *
from Autodesk.Revit.UI import *

doc = DocumentManager.Instance.CurrentDBDocument
uiapp = DocumentManager.Instance.CurrentUIApplication 
app = uiapp.Application 
uidoc = uiapp.ActiveUIDocument

def tolist(obj1):
    if isinstance(obj1,(list, tuple, set)): return obj1
    else: return [obj1]

#Preparing input from dynamo to revit
element = UnwrapElement(IN[0])

#Do some action in a Transaction

TransactionManager.Instance.EnsureInTransaction(doc)
"""
worksets = FilteredWorksetCollector(doc).OfKind(WorksetKind.UserWorkset) 

for workset in worksets:
    if workset.Name == "Floors":
       wf = workset

#worksetId = [i.Id for i in FilteredWorksetCollector(doc).OfKind(WorksetKind.UserWorkset).ToWorksets() if i.Name == "Workset1"][0]

ewf = ElementWorksetFilter(wf.Id)

catlist = List[BuiltInCategory]()
catlist.Add(BuiltInCategory.OST_Walls)
catlist.Add(BuiltInCategory.OST_Ceilings)

mce = ElementMulticategoryFilter(catlist)

elements = FilteredElementCollector(doc).WherePasses(ewf).WherePasses(mce).ToElements()
"""

fTypes = ["Desk1", "Desk2", "Desk3", "Desk4", "Desk5", "Desk1", "Desk2"]

f1 = "Desk1"
f2 = "Desk2"
f3 = "Desk3"

typeToCollect = ["Desk1", "Desk2", "Desk3"]

myList = []

for fType in fTypes:
    #if fType == f1 or fType == f2 or fType == f3:
    if fType in typeToCollect and fType.LookupParameter("Comments").AsString() == "Bat Man":
        myList.append(fType)



TransactionManager.Instance.TransactionTaskDone()


OUT = myList
# ----------------------------------------
byCoordinates = Point.ByCoordinates()
code_block = CodeBlock { 8; }
byCoordinates_2 = Point.ByCoordinates(x=code_block, z=code_block)
byStartPointEndPoint = Line.ByStartPointEndPoint(startPoint=byCoordinates, endPoint=byCoordinates_2)
geo_conversion = Python(IN[0]=byStartPointEndPoint)  # CPython3; frozen
# ---------- geo_conversion.python (60 lines) ----------
import clr

import sys
sys.path.append('C:\Program Files (x86)\IronPython 2.7\Lib')

import System
from System.Collections.Generic import *

clr.AddReference('ProtoGeometry')
from Autodesk.DesignScript.Geometry import *

clr.AddReference("RevitNodes")
import Revit
clr.ImportExtensions(Revit.Elements)
clr.ImportExtensions(Revit.GeometryConversion)
clr.AddReference("RevitServices")
import RevitServices
from RevitServices.Persistence import DocumentManager 
from RevitServices.Transactions import TransactionManager 

clr.AddReference("RevitAPI")
clr.AddReference("RevitAPIUI")

import Autodesk 
from Autodesk.Revit.DB import *
from Autodesk.Revit.DB.Electrical import *
from Autodesk.Revit.UI import *

doc = DocumentManager.Instance.CurrentDBDocument
uiapp = DocumentManager.Instance.CurrentUIApplication 
app = uiapp.Application 
uidoc = uiapp.ActiveUIDocument

def tolist(obj1):
	if isinstance(obj1,(list, tuple, set)): return obj1
	else: return [obj1]

#Preparing input from dynamo to revit

#dp = UnwrapElement(IN[0])
dynLine = UnwrapElement(IN[0])

#Do some action in a Transaction

TransactionManager.Instance.EnsureInTransaction(doc)

TransactionManager.Instance.TransactionTaskDone()

rp1 = XYZ()
rp2 = XYZ(2,2,2)

#rp1.ToPoint() //Revit Apiy XYZ to DYN Point
#revitLine.ToProtoType() //Revit Api Geo to Dyn Geo

#dp.ToXyz() //Dyn Point to Revit Api XYZ

revitLine = Line.CreateBound(rp1, rp2)


OUT = dynLine.ToRevitType()
# ----------------------------------------
light = DSModelElementSelection()  # 1 picked in the model
python_script = Python(IN[0]=light)  # CPython3
# ---------- python_script.python (50 lines) ----------
import clr

import sys
sys.path.append('C:\Program Files (x86)\IronPython 2.7\Lib')

import System
from System.Collections.Generic import *

clr.AddReference('ProtoGeometry')
from Autodesk.DesignScript.Geometry import *

clr.AddReference("RevitNodes")
import Revit
clr.ImportExtensions(Revit.Elements)
clr.ImportExtensions(Revit.GeometryConversion)
clr.AddReference("RevitServices")
import RevitServices
from RevitServices.Persistence import DocumentManager 
from RevitServices.Transactions import TransactionManager 

clr.AddReference("RevitAPI")
clr.AddReference("RevitAPIUI")

import Autodesk 
from Autodesk.Revit.DB import *
from Autodesk.Revit.DB.Electrical import *
from Autodesk.Revit.UI import *

doc = DocumentManager.Instance.CurrentDBDocument
uiapp = DocumentManager.Instance.CurrentUIApplication 
app = uiapp.Application 
uidoc = uiapp.ActiveUIDocument

def tolist(obj1):
	if isinstance(obj1,(list, tuple, set)): return obj1
	else: return [obj1]

#Preparing input from dynamo to revit
element = UnwrapElement(IN[0])

#Do some action in a Transaction

TransactionManager.Instance.EnsureInTransaction(doc)


#lp = element.Location.Point

TransactionManager.Instance.TransactionTaskDone()

OUT = element.Location.Point
# ----------------------------------------
wall = DSModelElementSelection()  # 1 picked in the model
python_script_2 = Python(IN[0]=light)  # CPython3
# ---------- python_script_2.python (56 lines) ----------
# Standard Dynamo Python Script template
import clr

clr.AddReference('RevitAPI')
clr.AddReference('RevitAPIUI')
clr.AddReference('RevitServices')
clr.AddReference('RevitNodes')

from Autodesk.Revit.DB import *
from Autodesk.Revit.DB.Electrical import *
from RevitServices.Persistence import DocumentManager

# Inputs from connected nodes
lighting_fixture = IN[0]

doc = DocumentManager.Instance.CurrentDBDocument

# Unwrap Dynamo element to get the native Revit element
if hasattr(lighting_fixture, "InternalElement"):
    revit_fixture = lighting_fixture.InternalElement
else:
    revit_fixture = lighting_fixture

output_point = None

if revit_fixture is not None:
    # 1. Retrieve the location point of the lighting fixture in internal coordinates
    location = revit_fixture.Location
    
    if isinstance(location, LocationPoint):
        internal_xyz = location.Point
        
        # 2. Get the active project's Survey Point element
        # In Revit, the Survey Point is a BasePoint element where IsShared is True
        collector = FilteredElementCollector(doc).OfClass(BasePoint)
        survey_point = None
        for bp in collector:
            if bp.IsShared: # IsShared == True represents the Survey Point
                survey_point = bp
                break
        
        if survey_point is not None:
            # 3. Retrieve the Survey Point's position relative to the internal origin
            # In Revit 2020+, we can use the SharedPosition property
            survey_xyz = survey_point.SharedPosition
            
            # 4. Subtract the Survey Point's offset from the internal coordinate
            # (Internal Position - Survey Point Position)
            relative_x = internal_xyz.X - survey_xyz.X
            relative_y = internal_xyz.Y - survey_xyz.Y
            relative_z = internal_xyz.Z - survey_xyz.Z
            
            output_point = XYZ(relative_x, relative_y, relative_z)

# Output must be assigned to OUT
OUT = output_point
# ----------------------------------------
