# Dynamo graph FEC3.dyn (Dynamo 3.3.0.6316)

python_script = Python()  # CPython3; frozen; unwired: IN[0]
# ---------- python_script.python (47 lines) ----------
import clr

import sys
sys.path.append('C:\Program Files (x86)\IronPython 2.7\Lib')

import System
from System.Collections.Generic import *

clr.AddReference('ProtoGeometry')
from Autodesk.DesignScript.Geometry import *

clr.AddReference("RevitNodes")
import Revit
clr.ImportExtensions(Revit.Elements)
clr.ImportExtensions(Revit.GeometryConversion)
clr.AddReference("RevitServices")
import RevitServices
from RevitServices.Persistence import DocumentManager 
from RevitServices.Transactions import TransactionManager 

clr.AddReference("RevitAPI")
clr.AddReference("RevitAPIUI")

import Autodesk 
from Autodesk.Revit.DB import *
from Autodesk.Revit.DB.Electrical import *
from Autodesk.Revit.UI import *

doc = DocumentManager.Instance.CurrentDBDocument
uiapp = DocumentManager.Instance.CurrentUIApplication 
app = uiapp.Application 
uidoc = uiapp.ActiveUIDocument

def tolist(obj1):
	if isinstance(obj1,(list, tuple, set)): return obj1
	else: return [obj1]

#Preparing input from dynamo to revit
element = UnwrapElement(IN[0])

#Do some action in a Transaction

TransactionManager.Instance.EnsureInTransaction(doc)

TransactionManager.Instance.TransactionTaskDone()

OUT = element
# ----------------------------------------
python_script_2 = Python()  # CPython3; frozen; unwired: IN[0]
# ---------- python_script_2.python (66 lines) ----------
import clr

import sys
sys.path.append('C:\Program Files (x86)\IronPython 2.7\Lib')

import System
from System.Collections.Generic import *

clr.AddReference('ProtoGeometry')
from Autodesk.DesignScript.Geometry import *

clr.AddReference("RevitNodes")
import Revit
clr.ImportExtensions(Revit.Elements)
clr.ImportExtensions(Revit.GeometryConversion)
clr.AddReference("RevitServices")
import RevitServices
from RevitServices.Persistence import DocumentManager 
from RevitServices.Transactions import TransactionManager 

clr.AddReference("RevitAPI")
clr.AddReference("RevitAPIUI")

import Autodesk 
from Autodesk.Revit.DB import *
from Autodesk.Revit.DB.Electrical import *
from Autodesk.Revit.UI import *

doc = DocumentManager.Instance.CurrentDBDocument
uiapp = DocumentManager.Instance.CurrentUIApplication 
app = uiapp.Application 
uidoc = uiapp.ActiveUIDocument

def tolist(obj1):
	if isinstance(obj1,(list, tuple, set)): return obj1
	else: return [obj1]

#Preparing input from dynamo to revit
element = UnwrapElement(IN[0])

#Do some action in a Transaction
TransactionManager.Instance.EnsureInTransaction(doc)
fec = FilteredElementCollector(doc)
walls = FilteredElementCollector(doc).OfClass(Wall).ToElements()
ducts = FilteredElementCollector(doc).OfClass(Duct).ToElements()
cableTrays = FilteredElementCollector(doc).OfClass(CableTray).ToElements()
activeView = doc.ActiveView
wallsInCurrentView = FilteredElementCollector(doc, activeView.Id).OfClass(Wall).ToElements()
catList = List[BuiltInCategory]()
catList.Add(BuiltInCategory.OST_Walls)
catList.Add(BuiltInCategory.OST_DuctCurves)
catList.Add(BuiltInCategory.OST_CableTray)
catFilt = ElementMulticategoryFilter(catList)
fec = FilteredElementCollector(doc).WherePasses(catFilt).WhereElementIsNotElementType().ToElements()
allLevels = FilteredElementCollector(doc).OfClass(Level).ToElements()
targetLevel = None
for level in allLevels:
    if level.Name == "LEVEL 2":
        targetLevel = level
        
       
      
levelFilt = ElementLevelFilter(level.Id)
fec2 = FilteredElementCollector(doc, activeView.Id).WherePasses(levelFilt).WherePasses(catFilt).ToElements()
TransactionManager.Instance.TransactionTaskDone()
OUT = fec, fec2v
# ----------------------------------------
railing_code = Python()  # CPython3; frozen; unwired: IN[0]
# ---------- railing_code.python (63 lines) ----------
import clr

import sys
sys.path.append('C:\Program Files (x86)\IronPython 2.7\Lib')

import System
from System.Collections.Generic import *

clr.AddReference('ProtoGeometry')
from Autodesk.DesignScript.Geometry import *

clr.AddReference("RevitNodes")
import Revit
clr.ImportExtensions(Revit.Elements)
clr.ImportExtensions(Revit.GeometryConversion)
clr.AddReference("RevitServices")
import RevitServices
from RevitServices.Persistence import DocumentManager 
from RevitServices.Transactions import TransactionManager 

clr.AddReference("RevitAPI")
clr.AddReference("RevitAPIUI")

import Autodesk 
from Autodesk.Revit.DB import *
from Autodesk.Revit.DB.Architecture import *
from Autodesk.Revit.DB.Electrical import *
from Autodesk.Revit.UI import *

doc = DocumentManager.Instance.CurrentDBDocument
uiapp = DocumentManager.Instance.CurrentUIApplication 
app = uiapp.Application 
uidoc = uiapp.ActiveUIDocument

def tolist(obj1):
	if isinstance(obj1,(list, tuple, set)): return obj1
	else: return [obj1]

#Preparing input from dynamo to revit
element = UnwrapElement(IN[0])

#Do some action in a Transaction

TransactionManager.Instance.EnsureInTransaction(doc)

railings = FilteredElementCollector(doc).OfClass(Railing).ToElements()

levelNames = []

temp = []

for railing in railings:
    rlId = railing.LevelId
    if rlId != ElementId.InvalidElementId:
        levelNames.append(doc.GetElement(rlId).Name)
    else:
        hostId = railing.HostId
        host = doc.GetElement(hostId)
        levelNames.append( host.LookupParameter("Base Level").AsValueString())

TransactionManager.Instance.TransactionTaskDone()

OUT = levelNames
# ----------------------------------------
python_script_3 = Python()  # CPython3; unwired: IN[0]
# ---------- python_script_3.python (68 lines) ----------
import clr

import sys
sys.path.append('C:\Program Files (x86)\IronPython 2.7\Lib')

#import System

from System import *
from System.Collections.Generic import *

clr.AddReference('ProtoGeometry')
from Autodesk.DesignScript.Geometry import *

clr.AddReference("RevitNodes")
import Revit
clr.ImportExtensions(Revit.Elements)
clr.ImportExtensions(Revit.GeometryConversion)
clr.AddReference("RevitServices")
import RevitServices
from RevitServices.Persistence import DocumentManager 
from RevitServices.Transactions import TransactionManager 

clr.AddReference("RevitAPI")
clr.AddReference("RevitAPIUI")

import Autodesk 
from Autodesk.Revit.DB import *
from Autodesk.Revit.DB.Electrical import *
from Autodesk.Revit.UI import *

doc = DocumentManager.Instance.CurrentDBDocument
uiapp = DocumentManager.Instance.CurrentUIApplication 
app = uiapp.Application 
uidoc = uiapp.ActiveUIDocument

def tolist(obj1):
	if isinstance(obj1,(list, tuple, set)): return obj1
	else: return [obj1]

#Preparing input from dynamo to revit
element = UnwrapElement(IN[0])

#Do some action in a Transaction

TransactionManager.Instance.EnsureInTransaction(doc)

typeList = List[Type]()
typeList.Add(Wall)
typeList.Add(CableTray)

classFilt = ElementMulticlassFilter(typeList)

level = FilteredElementCollector(doc).OfClass(Level).FirstElement()

levelFilter = ElementLevelFilter(level.Id)

orFilt = LogicalOrFilter(classFilt, levelFilter)


fec = FilteredElementCollector(doc).WherePasses(classFilt).WherePasses(levelFilter).ToElements()

fec1 = FilteredElementCollector(doc).WherePasses(orFilt).ToElements()



TransactionManager.Instance.TransactionTaskDone()

OUT = fec1
# ----------------------------------------
