# Dynamo graph Linked Model.dyn (Dynamo 3.3.0.6316)

select_model_element = DSModelElementSelection()  # 1 picked in the model
linked_model_name = CodeBlock { "MEP Model"; }
python_script = Python(IN[0]=select_model_element, IN[1]=linked_model_name)  # CPython3
# ---------- python_script.python (135 lines) ----------
import clr

import sys
sys.path.append('C:\Program Files (x86)\IronPython 2.7\Lib')

import System
from System.Collections.Generic import *

clr.AddReference('ProtoGeometry')
from Autodesk.DesignScript.Geometry import *

clr.AddReference("RevitNodes")
import Revit
clr.ImportExtensions(Revit.Elements)
clr.ImportExtensions(Revit.GeometryConversion)
clr.AddReference("RevitServices")
import RevitServices
from RevitServices.Persistence import DocumentManager 
from RevitServices.Transactions import TransactionManager 

clr.AddReference("RevitAPI")
clr.AddReference("RevitAPIUI")

import Autodesk 
from Autodesk.Revit.DB import *
from Autodesk.Revit.DB.Mechanical import *
from Autodesk.Revit.DB.Electrical import *
from Autodesk.Revit.UI import *

doc = DocumentManager.Instance.CurrentDBDocument
uiapp = DocumentManager.Instance.CurrentUIApplication 
app = uiapp.Application 
uidoc = uiapp.ActiveUIDocument

def tolist(obj1):
	if isinstance(obj1,(list, tuple, set)): return obj1
	else: return [obj1]

#Preparing input from dynamo to revit
ele = UnwrapElement(IN[0])

#Do some action in a Transaction

TransactionManager.Instance.EnsureInTransaction(doc)


geo = list(ele.get_Geometry(Options()))[0]

solids = geo.GetInstanceGeometry()

for solid in solids:
    if solid.Volume != 0:
        colSolid = solid
        break

solidFilt = ElementIntersectsSolidFilter(colSolid)

bb = ele.get_BoundingBox(None)
bbFilt = BoundingBoxIntersectsFilter(Outline(bb.Min, bb.Max))


clashes = FilteredElementCollector(doc).OfClass(Ceiling).WherePasses(bbFilt).WherePasses(solidFilt).ToElements()

















links = FilteredElementCollector(doc).OfClass(RevitLinkInstance).ToElements()

temp = []

for link in links:
    linkDoc = link.GetLinkDocument()
    if linkDoc.Title == "MEP Model":
        mepDoc = linkDoc

ducts = FilteredElementCollector(mepDoc).OfClass(Duct).ToElements()

values = []

for duct in ducts:
    param = duct.LookupParameter("Comments")
    paramValue = param.AsString()
    values.append(paramValue)
  












temp = []    

walls = FilteredElementCollector(doc).OfClass(Wall).ToElements()

for wall in walls:
    bb = wall.get_BoundingBox(None)
    bbFilt = BoundingBoxIntersectsFilter(Outline(bb.Min, bb.Max))
    
    geo = wall.get_Geometry(Options())
    
    solid = list(geo)[0]
    
    solidFilt = ElementIntersectsSolidFilter(solid)
    
    clashes = FilteredElementCollector(mepDoc).OfClass(Duct).WherePasses(bbFilt).WherePasses(solidFilt).ToElements()
    
    if len(clashes) > 0:
        temp.append([wall, clashes])



TransactionManager.Instance.TransactionTaskDone()



OUT = temp
# ----------------------------------------
