# Dynamo graph Parameters.dyn (Dynamo 3.3.0.6316)

select_model_element = DSModelElementSelection()  # 1 picked in the model
levels = Levels("Level -1")
python_script = Python(IN[0]=select_model_element, IN[1]=levels)  # CPython3; frozen
# ---------- python_script.python (83 lines) ----------
import clr

import sys
sys.path.append('C:\Program Files (x86)\IronPython 2.7\Lib')

import System
from System.Collections.Generic import *

clr.AddReference('ProtoGeometry')
from Autodesk.DesignScript.Geometry import *

clr.AddReference("RevitNodes")
import Revit
clr.ImportExtensions(Revit.Elements)
clr.ImportExtensions(Revit.GeometryConversion)
clr.AddReference("RevitServices")
import RevitServices
from RevitServices.Persistence import DocumentManager 
from RevitServices.Transactions import TransactionManager 

clr.AddReference("RevitAPI")
clr.AddReference("RevitAPIUI")

import Autodesk 
from Autodesk.Revit.DB import *
from Autodesk.Revit.UI import *

doc = DocumentManager.Instance.CurrentDBDocument
uiapp = DocumentManager.Instance.CurrentUIApplication 
app = uiapp.Application 
uidoc = uiapp.ActiveUIDocument

def tolist(obj1):
    if isinstance(obj1,(list, tuple, set)): 
        return obj1
    else: 
        return [obj1]

#Preparing input from dynamo to revit

element = UnwrapElement(IN[0])
baseLevel = UnwrapElement(IN[1])


#Do some action in a Transaction



TransactionManager.Instance.EnsureInTransaction(doc)

comments = element.LookupParameter("Comments")
paramValue = comments.AsString()

#comments.Set("10016541651")

uh = element.LookupParameter("Unconnected Height")
uhValue = uh.AsDouble()*304.8

#uh.Set(8000/304.8)


rb = element.LookupParameter("Room Bounding")
#rb.Set(100)

ll = element.LookupParameter("Location Line")
ll.Set(5)

"""
bc = element.LookupParameter("Base Constraint")
bcValue = bc.AsElementId()
bcElement = doc.GetElement(bcValue)

bc.Set(baseLevel.Id)
"""

element.LookupParameter("Base Constraint").Set(baseLevel.Id)

TransactionManager.Instance.TransactionTaskDone()




OUT = type(315132), type(baseLevel.Id)
# ----------------------------------------
code_block = CodeBlock { "Comments"; }
getParameterValueByName = Element.GetParameterValueByName(element=select_model_element, parameterName=code_block)
code_block_2 = CodeBlock { "I'm Iron Man"; }
setParameterByName = Element.SetParameterByName(element=select_model_element, parameterName=code_block, value=code_block_2)  # frozen
select_model_elements = DSModelElementsSelection()  # 3 picked in the model
python_script_2 = Python(IN[0]=select_model_elements)  # CPython3; frozen
# ---------- python_script_2.python (56 lines) ----------
import clr

import sys
sys.path.append('C:\Program Files (x86)\IronPython 2.7\Lib')

import System
from System.Collections.Generic import *

clr.AddReference('ProtoGeometry')
from Autodesk.DesignScript.Geometry import *

clr.AddReference("RevitNodes")
import Revit
clr.ImportExtensions(Revit.Elements)
clr.ImportExtensions(Revit.GeometryConversion)
clr.AddReference("RevitServices")
import RevitServices
from RevitServices.Persistence import DocumentManager 
from RevitServices.Transactions import TransactionManager 

clr.AddReference("RevitAPI")
clr.AddReference("RevitAPIUI")

import Autodesk 
from Autodesk.Revit.DB import *
from Autodesk.Revit.UI import *

doc = DocumentManager.Instance.CurrentDBDocument
uiapp = DocumentManager.Instance.CurrentUIApplication 
app = uiapp.Application 
uidoc = uiapp.ActiveUIDocument

def tolist(obj1):
	if isinstance(obj1,(list, tuple, set)): return obj1
	else: return [obj1]

#Preparing input from dynamo to revit
elements = tolist(UnwrapElement(IN[0]))

#Do some action in a Transaction

TransactionManager.Instance.EnsureInTransaction(doc)


cpValueList = []

for wall in elements:
    cp = wall.LookupParameter("Comments")
    cpValue = cp.AsString()
    cpValueList.append(cpValue)
    #cp.Set("777")


TransactionManager.Instance.TransactionTaskDone()

OUT = cpValueList
# ----------------------------------------
select_model_element_2 = DSModelElementSelection()  # 1 picked in the model
elementType = Element.ElementType(element=select_model_element_2)
code_block_3 = CodeBlock { "Type Comments"; }
getParameterValueByName_2 = Element.GetParameterValueByName(element=elementType, parameterName=code_block_3)
select_model_element_3 = DSModelElementSelection()  # 1 picked in the model
python_script_3 = Python(IN[0]=select_model_element_3)  # CPython3
# ---------- python_script_3.python (57 lines) ----------
import clr

import sys
sys.path.append('C:\Program Files (x86)\IronPython 2.7\Lib')

import System
from System.Collections.Generic import *

clr.AddReference('ProtoGeometry')
from Autodesk.DesignScript.Geometry import *

clr.AddReference("RevitNodes")
import Revit
clr.ImportExtensions(Revit.Elements)
clr.ImportExtensions(Revit.GeometryConversion)
clr.AddReference("RevitServices")
import RevitServices
from RevitServices.Persistence import DocumentManager 
from RevitServices.Transactions import TransactionManager 

clr.AddReference("RevitAPI")
clr.AddReference("RevitAPIUI")

import Autodesk 
from Autodesk.Revit.DB import *
from Autodesk.Revit.UI import *

doc = DocumentManager.Instance.CurrentDBDocument
uiapp = DocumentManager.Instance.CurrentUIApplication 
app = uiapp.Application 
uidoc = uiapp.ActiveUIDocument

def tolist(obj1):
	if isinstance(obj1,(list, tuple, set)): return obj1
	else: return [obj1]

#Preparing input from dynamo to revit
element = UnwrapElement(IN[0])

#Do some action in a Transaction

TransactionManager.Instance.EnsureInTransaction(doc)

etId = element.GetTypeId()
et = doc.GetElement(etId)


tc = et.LookupParameter("Type Comments")

tcValue = tc.AsString()

#tc.Set("Loki")


TransactionManager.Instance.TransactionTaskDone()

OUT = tcValue
# ----------------------------------------
select_model_elements_2 = DSModelElementsSelection()  # 3 picked in the model
select_model_element_4 = DSModelElementSelection()  # 1 picked in the model
code_block_4 = CodeBlock { "HULK"; }
python_script_4 = Python(IN[0]=select_model_element_4, IN[1]=code_block_4)  # CPython3
# ---------- python_script_4.python (58 lines) ----------
import clr

import sys
sys.path.append('C:\Program Files (x86)\IronPython 2.7\Lib')

import System
from System.Collections.Generic import *

clr.AddReference('ProtoGeometry')
from Autodesk.DesignScript.Geometry import *

clr.AddReference("RevitNodes")
import Revit
clr.ImportExtensions(Revit.Elements)
clr.ImportExtensions(Revit.GeometryConversion)
clr.AddReference("RevitServices")
import RevitServices
from RevitServices.Persistence import DocumentManager 
from RevitServices.Transactions import TransactionManager 

clr.AddReference("RevitAPI")
clr.AddReference("RevitAPIUI")

import Autodesk 
from Autodesk.Revit.DB import *
from Autodesk.Revit.UI import *

doc = DocumentManager.Instance.CurrentDBDocument
uiapp = DocumentManager.Instance.CurrentUIApplication 
app = uiapp.Application 
uidoc = uiapp.ActiveUIDocument

def tolist(obj1):
	if isinstance(obj1,(list, tuple, set)): return obj1
	else: return [obj1]

#Preparing input from dynamo to revit
walls = tolist(UnwrapElement(IN[0]))
name = IN[1]

#Do some action in a Transaction

TransactionManager.Instance.EnsureInTransaction(doc)


values = []

for wall in walls:
    wallType = doc.GetElement(wall.GetTypeId())
    tc = wallType.LookupParameter("Type Comments")
    tcValue = tc.AsString()
    values.append(tcValue)
    tc.Set(name)


TransactionManager.Instance.TransactionTaskDone()

OUT = values
# ----------------------------------------
