# Dynamo graph Ray Trace.dyn (Dynamo 3.3.0.6316)

adithya_s_code = Python()  # CPython3; frozen; unwired: IN[0]
# ---------- adithya_s_code.python (79 lines) ----------
# ==========================
# IMPORTS
# ==========================

import clr
import sys

# Revit API
clr.AddReference("RevitAPI")
from Autodesk.Revit.DB import *
from Autodesk.Revit.UI import *

# Optional Namespaces
from Autodesk.Revit.DB.Architecture import *
from Autodesk.Revit.DB.Structure import *

# Dynamo Services
clr.AddReference("RevitServices")
from RevitServices.Persistence import DocumentManager
from RevitServices.Transactions import TransactionManager

clr.AddReference("System")
from System.Collections.Generic import List

# Dynamo Geometry (Only if needed)
clr.AddReference("ProtoGeometry")
from Autodesk.DesignScript.Geometry import *

# ==========================
# DOCUMENTS
# ==========================

doc = DocumentManager.Instance.CurrentDBDocument
uiapp = DocumentManager.Instance.CurrentUIApplication
uidoc = uiapp.ActiveUIDocument
app = uiapp.Application

# ==========================
# INPUTS
# ==========================

data = IN[0]

# ==========================
# CODE
# ==========================
import os

baseFolder = r"C:\Users\v.aditya\Projects\Architecture"
pdfFolder = os.path.join(baseFolder, "PDF")
dwgFolder = os.path.join(baseFolder, "DWG")


os.makedirs(pdfFolder, exist_ok=True)
os.makedirs(dwgFolder, exist_ok=True)


pdfops = PDFExportOptions()
pdfops.Combine = True
dwgops = DWGExportOptions()
dwgops.MergedViews = True

viewSheets = FilteredElementCollector(doc).OfClass(ViewSheet).ToElements()

for viewSheet in viewSheets:
    sheetList = List[ElementId]()
    sheetList.Add(viewSheet.Id)
    if "Floor Plan" in viewSheet.Name:
        name = pdfops.FileName = "Level"+viewSheet.SheetNumber+"-"+viewSheet.Name
        pdfs = doc.Export(pdfFolder, sheetList, pdfops)
        dwgs = doc.Export(dwgFolder, name, sheetList, dwgops)

# ==========================
# OUTPUT
# ==========================



OUT = a
# ----------------------------------------
nested_folders_creation = Python()  # CPython3; frozen; unwired: IN[0]
# ---------- nested_folders_creation.python (73 lines) ----------
# ==========================
# IMPORTS
# ==========================

import clr
import sys

# Revit API
clr.AddReference("RevitAPI")
from Autodesk.Revit.DB import *
from Autodesk.Revit.UI import *

# Namespaces
from Autodesk.Revit.DB.Architecture import *
from Autodesk.Revit.DB.Structure import *

# Dynamo Services
clr.AddReference("RevitServices")
from RevitServices.Persistence import DocumentManager
from RevitServices.Transactions import TransactionManager

clr.AddReference("System")
from System.Collections.Generic import List

# Dynamo Geometry (Only if needed)
clr.AddReference("ProtoGeometry")
from Autodesk.DesignScript.Geometry import *

# ==========================
# DOCUMENTS
# ==========================

doc = DocumentManager.Instance.CurrentDBDocument
uiapp = DocumentManager.Instance.CurrentUIApplication
uidoc = uiapp.ActiveUIDocument
app = uiapp.Application

# ==========================
# INPUTS
# ==========================

data = IN[0]

# ==========================
# CODE
# ==========================

import os

baseFolder = r"C:\Users\v.aditya\Projects\aDi"
project = "Sobha One"
disciplines =  ["Architecture", "Structure", "Mechanical", "Electrical"]
formateFolders = ["01. PDF","02. CAD","03. NWC", "04. IFC"]

projectFolder = os.path.join(baseFolder, project)
os.mkdir(projectFolder)

temp = []

for discipline in disciplines:
    disciplinefolder = os.path.join(projectFolder, discipline)
    os.mkdir(disciplinefolder)
    for formateFolder in formateFolders:
        formateFolder = os.path.join(disciplinefolder, formateFolder)
        os.mkdir(formateFolder)
        temp.append(formateFolder)


# ==========================
# OUTPUT
# ==========================

OUT = temp
# ----------------------------------------
select_model_element = DSModelElementSelection()  # 1 picked in the model
select_model_element_2 = DSModelElementSelection()  # 1 picked in the model
python_script = Python(IN[0]=select_model_element, IN[1]=select_model_element_2)  # CPython3
# ---------- python_script.python (149 lines) ----------
# ==========================
# IMPORTS
# ==========================

import clr
import sys

sys.path.append(r'C:\Program Files (x86)\IronPython 2.7\Lib')

from System import*
from System.Collections.Generic import *

clr.AddReference('ProtoGeometry')
from Autodesk.DesignScript.Geometry import *

clr.AddReference("RevitNodes")
import Revit
clr.ImportExtensions(Revit.Elements)
clr.ImportExtensions(Revit.GeometryConversion)
clr.AddReference("RevitServices")
import RevitServices
from RevitServices.Persistence import DocumentManager 
from RevitServices.Transactions import TransactionManager 

clr.AddReference("RevitAPI")
clr.AddReference("RevitAPIUI")

import Autodesk 
from Autodesk.Revit.DB import *
from Autodesk.Revit.DB.Structure import *
from Autodesk.Revit.DB.Mechanical import *
from Autodesk.Revit.DB.Electrical import *
from Autodesk.Revit.DB.Plumbing import *

from Autodesk.Revit.UI import *

# ==========================
# DOCUMENTS
# ==========================

doc = DocumentManager.Instance.CurrentDBDocument
uiapp = DocumentManager.Instance.CurrentUIApplication 
app = uiapp.Application 
uidoc = uiapp.ActiveUIDocument

def tolist(obj1):
    if isinstance(obj1,(list, tuple, set)): return obj1
    else: return [obj1]
# ==========================
# INPUTS
# ==========================

dl = UnwrapElement(IN[0])

TransactionManager.Instance.EnsureInTransaction(doc)

origin = dl.Location.Curve.Center

pt = XYZ(origin.X, origin.Y, origin.Z+0.6)

dir = XYZ(1,0,0)

views = FilteredElementCollector(doc).OfClass(View3D).ToElements()

for view in views:
    if view.Name == "{3D}":
        myView = view
        
"""
public ReferenceIntersector(
    ElementFilter filter,
    FindReferenceTarget targetType,
    View3D view3d
)"""

catFilt = ElementCategoryFilter(BuiltInCategory.OST_Walls)

ri = ReferenceIntersector(catFilt, FindReferenceTarget.Element, myView)

hit = ri.FindNearest(pt, dir)

distance = hit.Proximity

ref = hit.GetReference()

hitPoint = ref.GlobalPoint

ele = doc.GetElement(ref.ElementId)


hits = ri.Find(pt, dir)

elements = []

for h in hits:
    distance = h.Proximity
    ref = h.GetReference()
    
    hitPoint = ref.GlobalPoint
    
    ele = doc.GetElement(ref.ElementId)
    elements.append(hitPoint.ToPoint()) 



dl2 = UnwrapElement(IN[1])

botPoint = dl2.Location.Curve.Center

catFilt = ElementCategoryFilter(BuiltInCategory.OST_Ceilings)

ri = ReferenceIntersector(catFilt, FindReferenceTarget.Element, myView)

hit = ri.FindNearest(botPoint, XYZ(0,0,1))

distance = hit.Proximity

ref = hit.GetReference()

hitPoint = ref.GlobalPoint

ele = doc.GetElement(ref.ElementId)

"""public FamilyInstance NewFamilyInstance(
    XYZ location,
    FamilySymbol symbol,
    Element host,
    Level level,
    StructuralType structuralType
)"""


lightingTypes = FilteredElementCollector(doc).OfCategory(BuiltInCategory.OST_LightingFixtures).WhereElementIsElementType().ToElements()

for lt in lightingTypes:
    if lt.LookupParameter("Type Name").AsString() == "100W - 230V":
        ceilingLt = lt

level = doc.GetElement(ele.LevelId)

if ceilingLt.IsActive == False:
    ceilingLt.Activate()


newLight = doc.Create.NewFamilyInstance(hitPoint, ceilingLt, ele, level, StructuralType.NonStructural)

TransactionManager.Instance.TransactionTaskDone()

OUT = newLight
# ----------------------------------------
