# Dynamo graph Solid Filter.dyn (Dynamo 3.3.0.6316)

sheet_creation_adthiya = Python()  # CPython3; frozen; unwired: IN[0]
# ---------- sheet_creation_adthiya.python (89 lines) ----------
# ==========================
# IMPORTS
# ==========================

 import clr
 import sys

# Revit API
 clr.AddReference("RevitAPI")
 from Autodesk.Revit.DB import *
 from Autodesk.Revit.UI import *

# Optional Namespaces
 from Autodesk.Revit.DB.Architecture import *
 from Autodesk.Revit.DB.Structure import *
 from Autodesk.Revit.DB.Mechanical import *
 from Autodesk.Revit.DB.Plumbing import *
 from Autodesk.Revit.DB.Electrical import *

# Dynamo Services
 clr.AddReference("RevitServices")
 from RevitServices.Persistence import DocumentManager
 from RevitServices.Transactions import TransactionManager

 clr.AddReference("System")
 from System import Type
 from System.Collections.Generic import List

# Dynamo Geometry (Only if needed)
 clr.AddReference("ProtoGeometry")
 from Autodesk.DesignScript.Geometry import *

# ==========================
# DOCUMENTS
# ==========================

 doc = DocumentManager.Instance.CurrentDBDocument
 uiapp = DocumentManager.Instance.CurrentUIApplication
 uidoc = uiapp.ActiveUIDocument
 app = uiapp.Application

# ==========================
# INPUTS
# ==========================

 levelNames = UnwrapElement(IN[0])
 levelHeights = UnwrapElement(IN[1])
 sheetNumbers = UnwrapElement(IN[2])
 sheetNames = UnwrapElement(IN[3])
 titleBlocks = UnwrapElement(IN[4])

# ==========================
# CODE
# ==========================
TransactionManager.Instance.EnsureInTransaction(doc)

levels = FilteredElementCollector(doc).OfClass(Level)
names = [level.Name for level in levels] 

viewFamilyTypes = FilteredElementCollector(doc).OfClass(ViewFamilyType).ToElements()
titleblocks = FilteredElementCollector(doc).OfCategory(BuiltInCategory.OST_TitleBlocks).WhereElementIsElementType().ToElements()

tb = {}

for titleblock in titleblocks:
    typeName = titleblock.FamilyName
    tb[typeName] = titleblock

for viewFamilyType in viewFamilyTypes:
    if viewFamilyType.LookupParameter("Type Name").AsString() == "Architectural Plan":
        vt = viewFamilyType

for levelName, levelHeight, sheetNumber, sheetName, titleBlock in zip(levelNames, levelHeights, sheetNumbers, sheetNames, titleBlocks):
    if levelName not in names:
        newLevel = Level.Create(doc, levelHeight/304.8)
        newLevel.Name = levelName
    newView = ViewPlan.Create(doc, vt.Id, newLevel.Id)
    newView.Name = levelName+" - Architectural"
    newSheet = ViewSheet.Create(doc, tb[titleBlock].Id)
    newSheet.SheetNumber = sheetNumber
    newSheet.Name = sheetName
    Viewport.Create(doc, newSheet.Id, newView.Id, XYZ(594/304.8, 420/304.8, 0))

TransactionManager.Instance.TransactionTaskDone() 
# ==========================
# OUTPUT
# ==========================

OUT = tb
# ----------------------------------------
select_model_element = DSModelElementSelection()  # 1 picked in the model
clash_view_isolation = Python(IN[0]=select_model_element)  # CPython3; frozen
# ---------- clash_view_isolation.python (94 lines) ----------
# ==========================
# IMPORTS
# ==========================

import clr
import sys

# Revit API
clr.AddReference("RevitAPI")
from Autodesk.Revit.DB import *
from Autodesk.Revit.UI import *

# Optional Namespaces
from Autodesk.Revit.DB.Architecture import *
from Autodesk.Revit.DB.Structure import *
from Autodesk.Revit.DB.Mechanical import *
from Autodesk.Revit.DB.Plumbing import *
from Autodesk.Revit.DB.Electrical import *

# Dynamo Services
clr.AddReference("RevitServices")
from RevitServices.Persistence import DocumentManager
from RevitServices.Transactions import TransactionManager

clr.AddReference("System")
from System import Type
from System.Collections.Generic import List

# Dynamo Geometry (Only if needed)
clr.AddReference("ProtoGeometry")
from Autodesk.DesignScript.Geometry import *

# ==========================
# DOCUMENTS
# ==========================

doc = DocumentManager.Instance.CurrentDBDocument
uiapp = DocumentManager.Instance.CurrentUIApplication
uidoc = uiapp.ActiveUIDocument
app = uiapp.Application

# ==========================
# INPUTS
# ==========================

wall = UnwrapElement(IN[0])

# ==========================
# CODE
# ==========================
TransactionManager.Instance.EnsureInTransaction(doc)

bb = wall.get_BoundingBox(None)
bbo = Outline(bb.Min, bb.Max)
clashfilter = BoundingBoxIntersectsFilter(bbo)

catlist = List[Type]()
catlist.Add(Duct)
catlist.Add(Pipe)
catlist.Add(CableTray)

elefilter = ElementMulticlassFilter(catlist)

clashes = FilteredElementCollector(doc).WherePasses(elefilter).WherePasses(clashfilter).ToElements()

eleidlist = List[ElementId]()
eleidlist.Add(wall.Id)
for clash in clashes:
    eleidlist.Add(clash.Id)

viewFamilyTypes = FilteredElementCollector(doc).OfClass(ViewFamilyType)
for viewFamilyType in viewFamilyTypes:
    if viewFamilyType.ViewFamily == ViewFamily.ThreeDimensional:
        vt = viewFamilyType

clashview = View3D.CreateIsometric(doc, vt.Id)
clashview.Name = "WallvsMEP"
clashview.IsolateElementsTemporary(eleidlist)

pipes = FilteredElementCollector(doc).OfClass(Pipe).WherePasses(clashfilter).ToElements()

pipesIds = [pipe.Id for pipe in pipes]

os = OverrideGraphicSettings().SetProjectionLineColor(Color(255,0,0))

for pipesId in pipesIds:
    clashview.SetElementOverrides( pipesId, os)

TransactionManager.Instance.TransactionTaskDone() 
# ==========================
# OUTPUT
# ==========================

OUT = clashview
# ----------------------------------------
babu_code = Python()  # CPython3; frozen; unwired: IN[0]
# ---------- babu_code.python (123 lines) ----------
import clr

import sys
sys.path.append('C:\Program Files (x86)\IronPython 2.7\Lib')

import System
from System.Collections.Generic import *

clr.AddReference('ProtoGeometry')
from Autodesk.DesignScript.Geometry import *

clr.AddReference("RevitNodes")
import Revit
clr.ImportExtensions(Revit.Elements)
clr.ImportExtensions(Revit.GeometryConversion)
clr.AddReference("RevitServices")
import RevitServices
from RevitServices.Persistence import DocumentManager 
from RevitServices.Transactions import TransactionManager 

clr.AddReference("RevitAPI")
clr.AddReference("RevitAPIUI")

import Autodesk 
from Autodesk.Revit.DB import *
from Autodesk.Revit.DB.Electrical import *
from Autodesk.Revit.UI import *

doc = DocumentManager.Instance.CurrentDBDocument
uiapp = DocumentManager.Instance.CurrentUIApplication 
app = uiapp.Application 
uidoc = uiapp.ActiveUIDocument

def tolist(obj1):
	if isinstance(obj1,(list, tuple, set)): return obj1
	else: return [obj1]

#Preparing input from dynamo to revit
excelInp = tolist(UnwrapElement(IN[0]))

#Do some action in a Transaction

TransactionManager.Instance.EnsureInTransaction(doc)



views = FilteredElementCollector(doc).OfClass(View).ToElements()

plans = FilteredElementCollector(doc).OfClass(ViewPlan).ToElements()


"""
public static ViewPlan Create(
    Document document,
    ElementId viewFamilyTypeId,
    ElementId levelId
)
"""

vfts = FilteredElementCollector(doc).OfClass(ViewFamilyType).ToElements()


for vft in vfts:
    if vft.ViewFamily == ViewFamily.FloorPlan:
        floorPlanType = vft
         
     

levels = FilteredElementCollector(doc).OfClass(Level).ToElements()

""""

for level in levels:
    if level.Name == "Level 0":
        level0 = level
        
for level in levels:
    newFloorPlan = ViewPlan.Create(doc, floorPlanType.Id, level.Id)
    newFloorPlan.Name = "Babu's View" + level.Name

"""
rows = excelInp[1:]

levelsToCreate = [row[5] for row in rows]
viewNames = [row[3] for row in rows]
#levelsToCreate = [0]
#viewNames = ["GFPlan", "FFPlan"]

for levelToCreate, viewName in zip(levelsToCreate,viewNames):
    level = next((i for i in levels if i.Name == levelToCreate),None)
    if level is None:
        continue
    newFloorPlan = ViewPlan.Create(doc, floorPlanType.Id, level.Id)
    newFloorPlan.Name = viewName+"_"+levelToCreate

"""
 public static ViewSheet Create(
    Document document,
    ElementId titleBlockTypeId
)

"""

titleBlockTypes = FilteredElementCollector(doc).OfCategory(BuiltInCategory.OST_TitleBlocks).WhereElementIsElementType().ToElements()


for ttBlockType in titleBlockTypes:
    if ttBlockType.LookupParameter("Type Name").AsString() == "Standard":
        myTt = ttBlockType
        

sheetNames = [row[0] for row in rows]
sheetNumbers = [row[1] for row in rows]

for sheetName, sheetNumber in zip(sheetNames, sheetNumbers):
    newSheet = ViewSheet.Create(doc, myTt.Id)
    newSheet.Name = sheetName
    newSheet.SheetNumber = sheetNumber


TransactionManager.Instance.TransactionTaskDone()

OUT = newSheet
# ----------------------------------------
select_model_element_2 = DSModelElementSelection()  # 1 picked in the model
python_script = Python(IN[0]=select_model_element_2)  # CPython3; unwired: IN[1]
# ---------- python_script.python (73 lines) ----------
import clr

import sys
sys.path.append('C:\Program Files (x86)\IronPython 2.7\Lib')

import System
from System.Collections.Generic import *

clr.AddReference('ProtoGeometry')
from Autodesk.DesignScript.Geometry import *

clr.AddReference("RevitNodes")
import Revit
clr.ImportExtensions(Revit.Elements)
clr.ImportExtensions(Revit.GeometryConversion)
clr.AddReference("RevitServices")
import RevitServices
from RevitServices.Persistence import DocumentManager 
from RevitServices.Transactions import TransactionManager 

clr.AddReference("RevitAPI")
clr.AddReference("RevitAPIUI")

import Autodesk 
from Autodesk.Revit.DB import *
from Autodesk.Revit.DB.Plumbing import *
from Autodesk.Revit.DB.Mechanical import *
from Autodesk.Revit.DB.Electrical import *
from Autodesk.Revit.UI import *

doc = DocumentManager.Instance.CurrentDBDocument
uiapp = DocumentManager.Instance.CurrentUIApplication 
app = uiapp.Application 
uidoc = uiapp.ActiveUIDocument

def tolist(obj1):
	if isinstance(obj1,(list, tuple, set)): return obj1
	else: return [obj1]

#Preparing input from dynamo to revit
wall = UnwrapElement(IN[0])
type = UnwrapElement(IN[1])

#Do some action in a Transaction

TransactionManager.Instance.EnsureInTransaction(doc)


bb = wall.get_BoundingBox(None)
ot = Outline(bb.Min, bb.Max)

bbFilter = BoundingBoxIntersectsFilter(ot, -0.01)

classList = List[System.Type]()
classList.Add(Pipe)
classList.Add(Duct)

classFilt = ElementMulticlassFilter(classList)

wallGeo = wall.get_Geometry(Options())
wallSolid = list(wallGeo)[0]

solidFilter = ElementIntersectsSolidFilter(wallSolid)


clashes = FilteredElementCollector(doc).WherePasses(classFilt).WherePasses(bbFilter).WherePasses(solidFilter).ToElements()




TransactionManager.Instance.TransactionTaskDone()

OUT = clashes
# ----------------------------------------
wall_types = WallTypes("Concrete Wall")
python_script_2 = Python(IN[0]=select_model_element_2)  # CPython3
# ---------- python_script_2.python (82 lines) ----------
# Standard Dynamo Python Script template
import clr

clr.AddReference('RevitAPI')
clr.AddReference('RevitAPIUI')
clr.AddReference('RevitServices')
clr.AddReference('RevitNodes')

from Autodesk.Revit.DB import *
from Autodesk.Revit.DB.Plumbing import Pipe, PipeType
from RevitServices.Persistence import DocumentManager
from RevitServices.Transactions import TransactionManager

# Inputs from connected nodes are available via IN list
# IN[0] - wall (Element)
# IN[1] - document (Document)

doc = DocumentManager.Instance.CurrentDBDocument
uidoc = DocumentManager.Instance.CurrentUIApplication.ActiveUIDocument

wall = UnwrapElement(IN[0])

# Get the wall's solid geometry
opt = Options()
opt.ComputeReferences = True
opt.IncludeNonVisibleObjects = False
opt.DetailLevel = ViewDetailLevel.Coarse
opt.IncludeHiddenElements = False

geomElem = wall.get_Geometry(opt)

# Find the solid from the geometry
solid = None
for geo in geomElem:
    if isinstance(geo, Solid):
        if geo.Volume > 0:
            solid = geo
            break
    elif isinstance(geo, GeometryInstance):
        inst = geo.GetInstanceGeometry()
        for g in inst:
            if isinstance(g, Solid):
                if g.Volume > 0:
                    solid = g
                    break

# Get the bounding box of the wall
bbox = wall.get_BoundingBox(None)

if bbox is None or solid is None:
    OUT = []
else:
    # Expand the bounding box by 25mm (0.025 meters)
    tolerance = 0.025  # 25mm in meters
    minPt = bbox.Min
    maxPt = bbox.Max
    newMin = XYZ(minPt.X - tolerance, minPt.Y - tolerance, minPt.Z - tolerance)
    newMax = XYZ(maxPt.X + tolerance, maxPt.Y + tolerance, maxPt.Z + tolerance)
    scaledBbox = BoundingBoxXYZ()
    scaledBbox.Min = newMin
    scaledBbox.Max = newMax

    # Create a solid from the scaled bounding box using Solid.CreateBox
    scaledSolid = Solid.CreateBox(scaledBbox)

    # Create filters
    bboxFilter = BoundingBoxIntersectsFilter(scaledBbox)
    solidFilter = ElementIntersectsSolidFilter(scaledSolid)

    # Get all pipe elements and apply bounding box filter first
    collector = FilteredElementCollector(doc)
    pipes = collector.OfCategory(BuiltInCategory.OST_PipeCurves).WhereElementIsNotElementType().WherePasses(bboxFilter).ToElements()

    # Apply solid filter to get elements that actually intersect
    intersectingElements = []
    for pipe in pipes:
        if solidFilter.PassesFilter(pipe):
            # Exclude the wall itself (though pipes shouldn't match wall Id)
            if pipe.Id != wall.Id:
                intersectingElements.append(pipe)

    OUT = intersectingElements
# ----------------------------------------
