# Dynamo graph UI.dyn (Dynamo 3.3.0.6316)

titlt_panel = Python()  # CPython3; frozen; unwired: IN[0]
# ---------- titlt_panel.python (52 lines) ----------
import clr

import sys
sys.path.append('C:\Program Files (x86)\IronPython 2.7\Lib')

import System
from System.Collections.Generic import *

clr.AddReference('ProtoGeometry')
from Autodesk.DesignScript.Geometry import *

clr.AddReference("RevitNodes")
import Revit
clr.ImportExtensions(Revit.Elements)
clr.ImportExtensions(Revit.GeometryConversion)

clr.AddReference("RevitServices")
import RevitServices
from RevitServices.Persistence import DocumentManager 
from RevitServices.Transactions import TransactionManager 

clr.AddReference("RevitAPI")
clr.AddReference("RevitAPIUI")

clr.AddReference('System.Windows.Forms')
clr.AddReference('PresentationCore')
clr.AddReference ('AdWindows')


import Autodesk.Windows as adwin
from System.Windows.Media import RotateTransform

import Autodesk 
from Autodesk.Revit.DB import *
from Autodesk.Revit.UI import *

doc = DocumentManager.Instance.CurrentDBDocument
uiapp = DocumentManager.Instance.CurrentUIApplication 
app = uiapp.Application 
uidoc = uiapp.ActiveUIDocument


def tilt_ribbon (angle):
    ribbon = adwin. ComponentManager.Ribbon 
    ribbon.RenderTransform = RotateTransform(angle)
    return ribbon


TransactionManager.Instance. EnsureInTransaction(doc)
TransactionManager.Instance.TransactionTaskDone()

OUT = tilt_ribbon(0)
# ----------------------------------------
winform_demo = Python()  # CPython3; frozen; unwired: IN[0]
# ---------- winform_demo.python (88 lines) ----------
import clr

# .NET references
clr.AddReference('System.Windows.Forms')
clr.AddReference('System.Drawing')

from System.Windows.Forms import Form, Label, TextBox, NumericUpDown, TrackBar, CheckBox, Button, DialogResult
from System.Drawing import Point, Size
from System import Decimal

class SimpleForm(Form):
    def __init__(self):
        self.Text = "AI is comming for your job!!!"
        self.Size = Size(800, 800)

        # Name
        self.labelName = Label()
        self.labelName.Text = "Name:"
        self.labelName.Location = Point(10, 20)

        self.textName = TextBox()
        self.textName.Location = Point(120, 20)
        self.textName.Width = 150

        # Age (NumericUpDown requires Decimal)
        self.labelAge = Label()
        self.labelAge.Text = "Age:"
        self.labelAge.Location = Point(10, 60)

        self.numAge = NumericUpDown()
        self.numAge.Location = Point(120, 60)
        self.numAge.Width = 60
        self.numAge.Minimum = Decimal(0)
        self.numAge.Maximum = Decimal(120)
        self.numAge.Value = Decimal(25)

        # Experience (Slider)
        self.labelExp = Label()
        self.labelExp.Text = "Experience:"
        self.labelExp.Location = Point(10, 100)

        self.sliderExp = TrackBar()
        self.sliderExp.Location = Point(120, 90)
        self.sliderExp.Width = 150
        self.sliderExp.Minimum = 0
        self.sliderExp.Maximum = 40
        self.sliderExp.TickFrequency = 5
        self.sliderExp.Value = 5

        # Married checkbox
        self.checkMarried = CheckBox()
        self.checkMarried.Text = "Married"
        self.checkMarried.Location = Point(120, 140)

        # Submit Button
        self.buttonSubmit = Button()
        self.buttonSubmit.Text = "Submit"
        self.buttonSubmit.Location = Point(100, 200)
        self.buttonSubmit.Click += self.on_submit

        # Add controls
        self.Controls.Add(self.labelName)
        self.Controls.Add(self.textName)
        self.Controls.Add(self.labelAge)
        self.Controls.Add(self.numAge)
        self.Controls.Add(self.labelExp)
        self.Controls.Add(self.sliderExp)
        self.Controls.Add(self.checkMarried)
        self.Controls.Add(self.buttonSubmit)

        self.result = None

    def on_submit(self, sender, args):
        self.result = {
            "Name": self.textName.Text,
            "Age": int(self.numAge.Value),  # convert Decimal → int safely
            "Experience": self.sliderExp.Value,
            "Married": self.checkMarried.Checked
        }
        self.DialogResult = DialogResult.OK
        self.Close()


# Run form (modal)
form = SimpleForm()
form.ShowDialog()

OUT = form.result
# ----------------------------------------
adithya_s_code = Python()  # CPython3; frozen; unwired: IN[0]
# ---------- adithya_s_code.python (94 lines) ----------
# ==========================
# IMPORTS
# ==========================

import clr
import sys

# Revit API
clr.AddReference("RevitAPI")
from Autodesk.Revit.DB import *
from Autodesk.Revit.UI import *

# Namespaces
from Autodesk.Revit.DB.Architecture import *
from Autodesk.Revit.DB.Structure import *

# Dynamo Services
clr.AddReference("RevitServices")
from RevitServices.Persistence import DocumentManager
from RevitServices.Transactions import TransactionManager


clr.AddReference("RevitNodes")
import Revit
clr.ImportExtensions(Revit.GeometryConversion)

clr.AddReference("System")
from System.Collections.Generic import List

# Dynamo Geometry (Only if needed)
clr.AddReference("ProtoGeometry")
from Autodesk.DesignScript.Geometry import *

# ==========================
# DOCUMENTS
# ==========================

doc = DocumentManager.Instance.CurrentDBDocument
uiapp = DocumentManager.Instance.CurrentUIApplication
uidoc = uiapp.ActiveUIDocument
app = uiapp.Application

# ==========================
# INPUTS
# ==========================

desk = UnwrapElement(IN[0])

# ==========================
# CODE
# ==========================

TransactionManager.Instance.EnsureInTransaction(doc)

view3Ds = FilteredElementCollector(doc).OfClass(View3D).ToElements()

for view3D in view3Ds:
    if view3D.Name == "{3D}":
        myView = view3D

rI = ReferenceIntersector(myView)

loc = desk.Location.Point #.ToPoint()

desktype = doc.GetElement(desk.GetTypeId())
deskDepth = desktype.LookupParameter("Depth").AsDouble()
deskpoint1 = XYZ(loc.X+(deskDepth/2), loc.Y, loc.Z)#.ToPoint()
deskpoint2 = XYZ(loc.X-(deskDepth/2), loc.Y, loc.Z)#.ToPoint()

hit1 = rI.FindNearest(deskpoint1, XYZ(1,0,0))
hit2 = rI.FindNearest(deskpoint2, XYZ(-1,0,0))


dis1 = round(hit1.Proximity*304.8)
dis2 = round(hit2.Proximity*304.8)
std = 50


if dis1<dis2:
    if dis1 != 50/304.8:
        ElementTransformUtils.MoveElement(doc, desk.Id, XYZ((dis1-std)/304.8, 0, 0))
else:
    if dis2 != 50/304.8:
        ElementTransformUtils.MoveElement(doc, desk.Id, XYZ(-(dis2-std)/304.8, 0, 0))
   


TransactionManager.Instance.TransactionTaskDone()

# ==========================
# OUTPUT
# ==========================

OUT = loc
# ----------------------------------------
python_script = Python()  # CPython3; frozen; unwired: IN[0]
# ---------- python_script.python (91 lines) ----------
# ==========================
# IMPORTS
# ==========================

import clr
import sys

sys.path.append(r'C:\Program Files (x86)\IronPython 2.7\Lib')

from System import*
from System.Collections.Generic import *

clr.AddReference('ProtoGeometry')
from Autodesk.DesignScript.Geometry import *

clr.AddReference("RevitNodes")
import Revit
clr.ImportExtensions(Revit.Elements)
clr.ImportExtensions(Revit.GeometryConversion)
clr.AddReference("RevitServices")
import RevitServices
from RevitServices.Persistence import DocumentManager 
from RevitServices.Transactions import TransactionManager 

clr.AddReference("RevitAPI")
clr.AddReference("RevitAPIUI")

import Autodesk 
from Autodesk.Revit.DB import *
from Autodesk.Revit.DB.Mechanical import *
from Autodesk.Revit.DB.Electrical import *
from Autodesk.Revit.DB.Plumbing import *

from Autodesk.Revit.UI import *

# ==========================
# DOCUMENTS
# ==========================

doc = DocumentManager.Instance.CurrentDBDocument
uiapp = DocumentManager.Instance.CurrentUIApplication 
app = uiapp.Application 
uidoc = uiapp.ActiveUIDocument

def tolist(obj1):
    if isinstance(obj1,(list, tuple, set)): return obj1
    else: return [obj1]
# ==========================
# INPUTS
# ==========================

element = UnwrapElement(IN[0])

# ==========================
# CODE
# ==========================

TransactionManager.Instance.EnsureInTransaction(doc)

walls = FilteredElementCollector(doc).OfClass(Wall).ToElements()

result = ""

for wall in walls:
    result += wall.Name  + "\n"


#TaskDialog.Show("INFO", result)

ids = List[ElementId]()

for wall in walls:
    ids.Add(wall.Id)
    
#uidoc.Selection.SetElementIds(ids)

selectedElesIds = uidoc.Selection.GetElementIds()

uidoc

eles = []

for id in selectedElesIds:
    eles.append(doc.GetElement(id))




TransactionManager.Instance.TransactionTaskDone()

OUT = eles
# ----------------------------------------
select_model_element = DSModelElementSelection()  # nothing selected
python_script_2 = Python()  # CPython3; unwired: IN[0]
# ---------- python_script_2.python (155 lines) ----------
# ==========================
# IMPORTS
# ==========================

import clr
import sys

sys.path.append(r'C:\Program Files (x86)\IronPython 2.7\Lib')

from System import*
from System.Collections.Generic import *

clr.AddReference('ProtoGeometry')
from Autodesk.DesignScript.Geometry import *

clr.AddReference("RevitNodes")
import Revit
clr.ImportExtensions(Revit.Elements)
clr.ImportExtensions(Revit.GeometryConversion)
clr.AddReference("RevitServices")
import RevitServices
from RevitServices.Persistence import DocumentManager 
from RevitServices.Transactions import TransactionManager 

clr.AddReference("RevitAPI")
clr.AddReference("RevitAPIUI")

import Autodesk 
from Autodesk.Revit.DB import *
from Autodesk.Revit.DB.Mechanical import *
from Autodesk.Revit.DB.Electrical import *
from Autodesk.Revit.DB.Plumbing import *
from Autodesk.Revit.UI.Selection import *

from Autodesk.Revit.UI import *

# ==========================
# DOCUMENTS
# ==========================

doc = DocumentManager.Instance.CurrentDBDocument
uiapp = DocumentManager.Instance.CurrentUIApplication 
app = uiapp.Application 
uidoc = uiapp.ActiveUIDocument

def tolist(obj1):
    if isinstance(obj1,(list, tuple, set)): return obj1
    else: return [obj1]
# ==========================
# INPUTS
# ==========================

element = UnwrapElement(IN[0])


#eles = uidoc.Selection.PickElementsByRectangle("Select first you IDIOT!")

"""
ref = uidoc.Selection.PickObject(ObjectType.LinkedElement, "Please pick an Element and proceed!")
ele = doc.GetElement(ref.ElementId)

linkDoc = ele.GetLinkDocument()

linkedId = ref.LinkedElementId
linkedEle = linkDoc.GetElement(linkedId)
"""

"""

refs = uidoc.Selection.PickObjects(ObjectType.Element)

eles = []

for i in refs:
    ele = doc.GetElement(i.ElementId)
    eles.append(ele)

#eles = [doc.GetElement(i.ElementId) for i in refs]
"""

test = ""

class MyFilter:
    def __new__(cls):
        cls.__namespace__ = "MySelectionFilter_8F4A1C2D"   # Change if you modify the class

        try:
            # Reuse the CLR type if it has already been created
            module = __import__(cls.__namespace__)
            return module._InnerFilter()

        except ImportError:

            class _InnerFilter(ISelectionFilter):
                __namespace__ = cls.__namespace__
            
                def __init__(self):
                    super().__init__()
            
                def AllowElement(self, element):
                    test = "AllowElement"
                    return (
                        element.Category
                        and element.Category.Name == "Walls"
                    )
            
                def AllowReference(self, reference, point):
                    print("AllowReference")
                    return False


# Usage
filt = MyFilter()

class Custom_SelectionElem:
    def __new__(cls, *args, **kwargs):
        cls.args = args
        # name of namespace : "CustomNameSpace" + "_" + shortUUID (8 characters)
        # IMPORTANT NOTE Each time you modify this class, you must change the namesapce name.
        cls.__namespace__ = "SelectionNameSpace_tEfYX0DHEF"
        try:
            # 1. Try to import the module and class. If it already exists, you've probably already created 
            module_type = __import__(cls.__namespace__)
            return module_type._InnerClassInterface(*cls.args)
        except ImportError as ex:
            print(ex)
            # 2. If we get an ImportError, then the derivative class hasn't been built. Build it. Make sure to set the
            #    __namespace__ so that it is created with the appropriate .Net namespace.
            class _InnerClassInterface(ISelectionFilter):
                __namespace__ = cls.__namespace__
                #
                def __init__(self, bic):
                    super().__init__()
                    self.bic = bic
                    
                def AllowElement(self, e):
                    if e.Category.Name == "Walls":
                        return True
                    else:
                        return False
                def AllowReference(self, ref, point):
                    return True 
                    
            return _InnerClassInterface(*cls.args)

c = Custom_SelectionElem()

eles = uidoc.Selection.PickElementsByRectangle(c)


TransactionManager.Instance.EnsureInTransaction(doc)

TransactionManager.Instance.TransactionTaskDone()

OUT = test
# ----------------------------------------
