# Dynamo graph Unwrap, tolist and transaction.dyn (Dynamo 3.3.0.6316)

select_model_elements = DSModelElementsSelection()  # 4 picked in the model
python_script = Python(IN[0]=select_model_elements)  # CPython3
# ---------- python_script.python (101 lines) ----------
import clr

import sys
sys.path.append('C:\Program Files (x86)\IronPython 2.7\Lib')

import System
from System.Collections.Generic import *

clr.AddReference('ProtoGeometry')
from Autodesk.DesignScript.Geometry import *

clr.AddReference("RevitNodes")
import Revit
clr.ImportExtensions(Revit.Elements)
clr.ImportExtensions(Revit.GeometryConversion)
clr.AddReference("RevitServices")
import RevitServices
from RevitServices.Persistence import DocumentManager 
from RevitServices.Transactions import TransactionManager 

clr.AddReference("RevitAPI")
clr.AddReference("RevitAPIUI")

import Autodesk 
from Autodesk.Revit.DB import *
from Autodesk.Revit.UI import *

doc = DocumentManager.Instance.CurrentDBDocument
uiapp = DocumentManager.Instance.CurrentUIApplication 
app = uiapp.Application 
uidoc = uiapp.ActiveUIDocument

def tolist(obj1):
	if isinstance(obj1,(list, tuple, set)): return obj1
	else: return [obj1]

#Preparing input from dynamo to revit
element = UnwrapElement(IN[0])

#Do some action in a Transaction

TransactionManager.Instance.EnsureInTransaction(doc)

TransactionManager.Instance.TransactionTaskDone()




































#print(123)

#tolist(input)

input = IN[0]
unwrapedInput = UnwrapElement(input)
listInput = tolist(unwrapedInput)



elements = tolist(UnwrapElement(IN[0]))

nameList = []

for element in elements:
    name = element.Name
    nameList.append(name)



OUT = 10, [10]
# ----------------------------------------
code_block = CodeBlock { 11465465; "xyz"; }
select_model_elements_2 = DSModelElementsSelection()  # 4 picked in the model
name = Element.Name(element=select_model_elements_2)
select_model_element = DSModelElementSelection()  # 1 picked in the model
id = Element.Id(element=select_model_element)
isPinned = Element.IsPinned()  # unwired: element
select_model_element_2 = DSModelElementSelection()  # 1 picked in the model
select_model_element_3 = DSModelElementSelection()  # 1 picked in the model
python_script_2 = Python(IN[0]=select_model_element_3)  # CPython3
# ---------- python_script_2.python (55 lines) ----------
import clr

import sys
sys.path.append('C:\Program Files (x86)\IronPython 2.7\Lib')

import System
from System.Collections.Generic import *

clr.AddReference('ProtoGeometry')
from Autodesk.DesignScript.Geometry import *

clr.AddReference("RevitNodes")
import Revit
clr.ImportExtensions(Revit.Elements)
clr.ImportExtensions(Revit.GeometryConversion)
clr.AddReference("RevitServices")
import RevitServices
from RevitServices.Persistence import DocumentManager 
from RevitServices.Transactions import TransactionManager 

clr.AddReference("RevitAPI")
clr.AddReference("RevitAPIUI")

import Autodesk 
from Autodesk.Revit.DB import *
from Autodesk.Revit.UI import *

doc = DocumentManager.Instance.CurrentDBDocument
uiapp = DocumentManager.Instance.CurrentUIApplication 
app = uiapp.Application 
uidoc = uiapp.ActiveUIDocument

def tolist(obj1):
	if isinstance(obj1,(list, tuple, set)): return obj1
	else: return [obj1]

#Preparing input from dynamo to revit
element = tolist(UnwrapElement(IN[0]))

#Do some action in a Transaction

TransactionManager.Instance.EnsureInTransaction(doc)

nameList = []

for i in element:
    name = i.Name
    nameList.append(name)
    i.Pinned = True

TransactionManager.Instance.TransactionTaskDone()



OUT = nameList
# ----------------------------------------
