# Dynamo graph Views.dyn (Dynamo 3.3.0.6316)

code_block = CodeBlock()
# ---------- code_block.designscript (4 lines) ----------
["Sheet 1", "Sheet 2", "Sheet 3"];
["S01", "S02", "S03"];
["Standard", "Standard", "Standard"];
["Iron Man", "Bat Man", "Spider Man"];
# ----------------------------------------
python_script = Python(IN[0]=code_block.out0, IN[1]=code_block.out1, IN[2]=code_block.out2, IN[3]=code_block.out3)  # CPython3; frozen
# ---------- python_script.python (159 lines) ----------
import clr

import sys
sys.path.append('C:\Program Files (x86)\IronPython 2.7\Lib')

import System
from System.Collections.Generic import *

clr.AddReference('ProtoGeometry')
from Autodesk.DesignScript.Geometry import *

clr.AddReference("RevitNodes")
import Revit
clr.ImportExtensions(Revit.Elements)
clr.ImportExtensions(Revit.GeometryConversion)
clr.AddReference("RevitServices")
import RevitServices
from RevitServices.Persistence import DocumentManager 
from RevitServices.Transactions import TransactionManager 

clr.AddReference("RevitAPI")
clr.AddReference("RevitAPIUI")

import Autodesk 
from Autodesk.Revit.DB import *
from Autodesk.Revit.DB.Electrical import *
from Autodesk.Revit.UI import *

doc = DocumentManager.Instance.CurrentDBDocument
uiapp = DocumentManager.Instance.CurrentUIApplication 
app = uiapp.Application 
uidoc = uiapp.ActiveUIDocument

def tolist(obj1):
	if isinstance(obj1,(list, tuple, set)): return obj1
	else: return [obj1]

#Preparing input from dynamo to revit
element = UnwrapElement(IN[0])

#Do some action in a Transaction

TransactionManager.Instance.EnsureInTransaction(doc)


views = FilteredElementCollector(doc).OfClass(View).ToElements()

#doc.ActiveView.CropBoxActive = True
planViews = FilteredElementCollector(doc).OfClass(View3D).ToElements()


"""
public static ViewPlan Create(
    Document document,
    ElementId viewFamilyTypeId,
    ElementId levelId
)"""


vfts = FilteredElementCollector(doc).OfClass(ViewFamilyType).ToElements()


for vft in vfts:
    if vft.ViewFamily == ViewFamily.FloorPlan:
        floorPlanType = vft


levels = FilteredElementCollector(doc).OfClass(Level).ToElements()

level0 = [i for i in levels if i.Name == "Level 0"][0]

levelsToCreate = [ "Level 0", "Level 1" ]
viewNames = ["Iron Man", "Bat Man"]


"""
for level in levels:
    newFloorPlan = ViewPlan.Create(doc, floorPlanType.Id, level.Id)
    newFloorPlan.Name = "Ashim's View-"+level.Name

#level = [i for i in levels if i.Name == levelToCreate][0]

for levelToCreate, viewName in zip(levelsToCreate,viewNames) :
    for level in levels:
        if level.Name == levelToCreate:
            newFloorPlan = ViewPlan.Create(doc, floorPlanType.Id, level.Id)
            newFloorPlan.Name = viewName
"""

"""
public static ViewSheet Create(
    Document document,
    ElementId titleBlockTypeId
)"""


ttBlockTypes = FilteredElementCollector(doc).OfCategory(BuiltInCategory.OST_TitleBlocks).WhereElementIsElementType().ToElements()


for tt in ttBlockTypes:
    if tt.LookupParameter("Type Name").AsString() == "Standard":
        myTt = tt



"""
public static Viewport Create(
    Document document,
    ElementId viewSheetId,
    ElementId viewId,
    XYZ point
)"""

"""
sheets = FilteredElementCollector(doc).OfClass(ViewSheet).ToElements()

for sheet in sheets:
    if sheet.Name == "Ronak" and sheet.SheetNumber == "07":
        mySheet = sheet


plans = FilteredElementCollector(doc).OfClass(ViewPlan).ToElements()

for plan in plans:
    if plan.Name == "Bat Man":
        myPlan = plan
        
        
newViewPort = Viewport.Create(doc, mySheet.Id, myPlan.Id, XYZ(1,1,0))
"""




sheetNames = IN[0]
sheetNumbers = IN[1]
ttNames = IN[2]
viewNames = IN[3]

plans = FilteredElementCollector(doc).OfClass(ViewPlan).ToElements()

for name, number, ttName, viewName in zip(sheetNames, sheetNumbers, ttNames, viewNames): 
   for tt in ttBlockTypes:
    if tt.LookupParameter("Type Name").AsString() == ttName:
        myTt = tt
    newSheet = ViewSheet.Create(doc, myTt.Id)
    newSheet.Name = name
    newSheet.SheetNumber = number
    for plan in plans:
        if plan.Name == viewName:
            myPlan = plan
    newViewPort = Viewport.Create(doc, newSheet.Id, myPlan.Id, XYZ(1,1,0))
    



TransactionManager.Instance.TransactionTaskDone()

OUT = newViewPort
# ----------------------------------------
python_script_2 = Python()  # CPython3; unwired: IN[0]
# ---------- python_script_2.python (75 lines) ----------
import clr

import sys
sys.path.append('C:\Program Files (x86)\IronPython 2.7\Lib')

import System
from System.Collections.Generic import *

clr.AddReference('ProtoGeometry')
from Autodesk.DesignScript.Geometry import *

clr.AddReference("RevitNodes")
import Revit
clr.ImportExtensions(Revit.Elements)
clr.ImportExtensions(Revit.GeometryConversion)
clr.AddReference("RevitServices")
import RevitServices
from RevitServices.Persistence import DocumentManager 
from RevitServices.Transactions import TransactionManager 

clr.AddReference("RevitAPI")
clr.AddReference("RevitAPIUI")

import Autodesk 
from Autodesk.Revit.DB import *
from Autodesk.Revit.DB.Electrical import *
from Autodesk.Revit.UI import *

doc = DocumentManager.Instance.CurrentDBDocument
uiapp = DocumentManager.Instance.CurrentUIApplication 
app = uiapp.Application 
uidoc = uiapp.ActiveUIDocument

def tolist(obj1):
	if isinstance(obj1,(list, tuple, set)): return obj1
	else: return [obj1]

#Preparing input from dynamo to revit
element = UnwrapElement(IN[0])

#Do some action in a Transaction

TransactionManager.Instance.EnsureInTransaction(doc)

view = doc.ActiveView

catId = ElementId(BuiltInCategory.OST_Walls)

#view.SetCategoryHidden(catId, False)


plans = FilteredElementCollector(doc).OfClass(ViewPlan).ToElements()

sections = FilteredElementCollector(doc).OfCategory(BuiltInCategory.OST_Viewers).WhereElementIsNotElementType().ToElements()

for section in sections:
    if section.Name == "To be hidden":
        hideSection = section


sectionList = List[ElementId]()
#sectionList.Add(ElementId(317567))
sectionList.Add(hideSection.Id)

for plan in plans:
    if plan.Name == "Bat Man":
        continue
    plan.HideElements(sectionList)




TransactionManager.Instance.TransactionTaskDone()

OUT = hideSection.Id
# ----------------------------------------
